# Grasshopper definition AutoPanel.gh (Grasshopper 1.0.7)
# plug-ins: EleFront, Human, Pufferfish, Heteroptera

layertable = LayerTable(Update=True, AutoUpdate=True)  # -> Layers, FullLayerPaths, LayerColors, Linetypes, MaterialNames, Visible, PrintWidth, PrintColor
# Da Rhino assicurarsi di avere i layer così ordinati:
# 
# dir-border-h
# dir-border-v
# 
# dir-h-x.x
# ...
# dir-v-x.x
# ...
# 
# i primi due sono DUE LINEE che determinano i bordi dell'area da pannellare. I bordi avranno anch'essi una fuga e andranno ridisegnati nei layer delle fughe
# 
# I layer seguenti sono tutte le fughe centrate che il codice utilizza per creare i pannelli
python = GhPythonScript(x=layertable.Layers)  # -> a; inputs x: list
# ---------- python: Python ----------
__author__ = "riccardo"
__version__ = "2023.02.16"

import rhinoscriptsyntax as rs

list = []

for i in x:
    if (i.split('-')[0] == 'dir'):
        list.append(i)

a = list
# ---------- end python ----------
panel = Panel(python)

# ---- group: OLD
cluster = Cluster()

# ----
reflay = ReferenceByLayer(LayerName="dir-border-h")
reflay_2 = ReferenceByLayer(LayerName="dir-border-v")
reflay_3 = ReferenceByLayer(LayerName="dir-h-2.2")
reflay_4 = ReferenceByLayer(LayerName="dir-h-8.8")
reflay_5 = ReferenceByLayer(LayerName="dir-v-8.8")

number_slider = Slider(8, range=0..10)

# ---- group: Origin
end = EndPoints(Curve=reflay)  # -> Start, End
pt = Point(end.Start)

# ----
B = Geometry(reflay)

# ---- group: H
geo = Geometry(reflay_2)

# ----
python_2 = GhPythonScript(x="dir-h-2.2")  # -> a, b
# ---------- python_2: Python ----------
__author__ = "riccardo"
__version__ = "2023.02.16"

import rhinoscriptsyntax as rs

if (x.split('-')[2].split('.')[0] == x.split('-')[2].split('.')[1]):
    a = x.split('-')[2].split('.')[0]
    b = -float(a)
# ---------- end python_2 ----------
python_3 = GhPythonScript(x="dir-h-8.8")  # -> a, b; same code as python_2
python_4 = GhPythonScript(x="dir-v-8.8")  # -> a, b; same code as python_2

offcrv = OffsetCurve(Curve=B, Plane=PlaneXY(0, 0, 0), Distance=number_slider, BothSides=expr("-x", number_slider), Kinks=0, CapType=0)  # -> flatten(Offset)
offcrv_2 = OffsetCurve(Curve=geo, Plane=PlaneXY(0, 0, 0), Distance=number_slider, BothSides=expr("-x", number_slider), Kinks=0, CapType=0)  # -> flatten(Offset)
offcrv_3 = OffsetCurve(Curve=reflay_3, Plane=PlaneXY(0, 0, 0), Distance=python_2.a, BothSides=python_2.b, Kinks=0, CapType=0)  # -> flatten(Offset)
offcrv_4 = OffsetCurve(Curve=reflay_4, Plane=PlaneXY(0, 0, 0), Distance=python_3.a, BothSides=python_3.b, Kinks=0, CapType=0)  # -> flatten(Offset)
offcrv_5 = OffsetCurve(Curve=reflay_5, Plane=PlaneXY(0, 0, 0), Distance=python_4.a, BothSides=python_4.b, Kinks=0, CapType=0)  # -> flatten(Offset)

merge = Merge(Data1=offcrv_3, Data2=offcrv_4)
merge_2 = Merge(Data1=offcrv_5)

merge_3 = Merge(Data1=offcrv, Data2=merge_2)
merge_4 = Merge(Data1=offcrv_2, Data2=merge)

mcx = MultipleCurves(Curves=merge_3)  # -> Points, IndexA, IndexB, ParamA, ParamB
mcx_2 = MultipleCurves(Curves=merge_4)  # -> Points, IndexA, IndexB, ParamA, ParamB

# ---- group: POINTS
c_script = CSharpScript(ptsX=mcx.Points, ptsY=mcx_2.Points, origin=pt)  # -> OptsX, OptsY; inputs ptsX: list of Point3d, ptsY: list of Point3d, origin: Point3d
# ---------- c_script: C# usings ----------
using System.Linq;
# ---------- c_script: C# ----------
    OptsX = Order(ptsX, 'x');
    OptsY = Order(ptsY, 'y');
# ---------- c_script: C# additional code ----------
  public List<Point3d> Order(List<Point3d> pts, char axis)
  {
    List<Point3d> sortedList = new List<Point3d>();

    double x = pts[1].X - pts[0].X;
    double y = pts[1].Y - pts[0].Y;

    if (axis == 'x')
    {
      if (x > y)
      {
        sortedList = pts.OrderBy(point => point.Y).ToList();
      }
      else
      {
        sortedList = pts.OrderBy(point => point.X).ToList();
      }
    }
    else
    {
      if (x < y)
      {
        sortedList = pts.OrderBy(point => point.Y).ToList();
      }
      else
      {
        sortedList = pts.OrderBy(point => point.X).ToList();
      }
    }

    return sortedList;
  }
# ---------- end c_script ----------

# ---- group: POINTS / Height Points
pt_2 = Point(c_script.OptsY)

# ---- group: POINTS / Base Points
pt_3 = Point(c_script.OptsX)

# ---- group: POINTS (continued)
item = ListItem(List=pt_2, Index=0, Wrap=True)
cull_i = CullIndex(List=pt_2, Indices=0, Wrap=True)
vec2pt = Vector2Pt(PointA=item, PointB=cull_i, Unitize=False)  # -> Vector, Length
crossref = CrossReference(ListA=pt_3, ListB=vec2pt.Vector, CrossMode=1)  # -> ListA, ListB
move = Move(Geometry=crossref.ListA, Motion=crossref.ListB)  # -> Geometry, Transform

ins = InsertItems(List=move.Geometry, Item=pt_3, Indices=0, Wrap=True)

# ---- group: Y PARAM
lng = ListLength(List=pt_3)

# ---- group: GENERATOR
c_script_2 = CSharpScript(x=ins, y=lng)  # -> flatten(A), flatten(B); inputs x: list of Point3d, y: Int32
# ---------- c_script_2: C# ----------
    List<Polyline> panels = new List<Polyline>();
    List<string> panelsNames = new List<string>();

    int k = x.Count - y - 1;

    for (int i = 0; i < k; i = i + 2)
    {
      int a = i + 1;
      int c = i / y;
      if (c % 2 == 0)
      {
        panels.Add(Panel(x, i, y));
        // && i % y
      }
      //      panels.Add(Panel(x, i, y));
    }

    for (int i = 0; i < panels.Count; i++)
    {
      panelsNames.Add(PanelData(panels[i], i));
    }

    A = panels;
    B = panelsNames;
# ---------- c_script_2: C# additional code ----------
  public Polyline Panel(List < Point3d > pointList, int i, int y)
  {
    List<Point3d> pList = new List<Point3d>() {
        pointList[i],
        pointList[i + 1],
        pointList[i + y + 1],
        pointList[i + y],
        pointList[i]
        };

    Polyline pl = new Polyline(pList);

    return pl;
  }

  public string PanelData(Polyline pl, int i)
  {
    double ba = pl[0].DistanceTo(pl[1]);
    double he = pl[1].DistanceTo(pl[2]);

    string item = Math.Round(ba, 0).ToString() + '-' + Math.Round(he, 0).ToString() + '|' + i.ToString();
    return item;
  }
# ---------- end c_script_2 ----------

# ---- group: PLINES
geo_2 = Geometry(c_script_2.A)

# ---- group: ARCHIVE
python_5 = GhPythonScript(x=c_script_2.B)  # -> a, b; inputs x: list
# ---------- python_5: Python ----------
__author__ = "riccardo"
__version__ = "2023.02.16"

import rhinoscriptsyntax as rs

list = []
panelLayer = []

for i in range(len(x)):
    a = x[i].split('-')
    list.append([float(a[0]),float(a[1].split('|')[0]), x[i].split('|')[0],i])
    panelLayer.append('%' + x[i].split('|')[0])

list = sorted(list, key = lambda x: (x[0], x[1]))

archive = [list[0][2]]


for i in range(1, len(x)):
    if (list[i][2] != list[i-1][2]):
        archive.append(list[i][2])

a = archive
b = panelLayer
# ---------- end python_5 ----------

# ----
area = Area(Geometry=geo_2)  # -> Area, Centroid

# ---- group: LAYERS
layers = CreateModifyLayers(LayerName=python_5.a, DeleteLayer=False, enableFullPath=False)  # -> LayerNames, LayerFullPath

# ----
# Click Bake su tutti e due i bottoni,
# uno per il testo e uno per le geometrie
panel_2 = Panel("BAKING STATION")
bake = Button()
qb = QuickBaker(Geometric=geo_2, Attribute=python_5.b, Bake=False)

textbaker = TextBaker(
    Location=area.Centroid,
    Text=c_script_2.B,
    Size="100",
    Attribute=python_5.b,
    Justification=4,
    Bake=bake,
    Dot_Text=False,
    Enable_Mask=True,
    On_Screen=False)

# ==== cluster Cluster
B = Geometry(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)  # disabled

# ---- group: H
geo = Geometry(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)  # disabled

# ----
list = ValueList({"Lenght": 0, "Divisions": 1}, selected="Lenght")  # disabled
gate = StreamGate(Stream=B, Gate=list)  # -> Target0, Target1; disabled
gate_2 = StreamGate(Stream=geo, Gate=list)  # -> Target0, Target1; disabled
number_slider = Slider(3000, range=0..3000)  # disabled
number_slider_2 = Slider(950, range=0..1000)  # disabled
divlength = DivideLength(Curve=gate.Target0, Length=expr("x*0.001", number_slider))  # -> Points, Tangents, Parameters; disabled
divlength_2 = DivideLength(Curve=gate_2.Target0, Length=expr("x*0.001", number_slider_2))  # -> Points, Tangents, Parameters; disabled
end = EndPoints(Curve=gate.Target0)  # -> Start, End; disabled
lng = ListLength(List=divlength.Points)  # disabled
ins = InsertItems(List=divlength.Points, Item=end.End, Indices=lng, Wrap=True)  # disabled
panel = Panel("0")  # disabled
cull_i = CullIndex(List=divlength_2.Points, Indices=panel, Wrap=True)  # disabled
end_2 = EndPoints(Curve=gate_2.Target0)  # -> Start, End; disabled
item = ListItem(List=divlength_2.Points, Index=panel, Wrap=True)  # disabled
lng_2 = ListLength(List=cull_i)  # disabled
ins_2 = InsertItems(List=cull_i, Item=end_2.End, Indices=lng_2, Wrap=True)  # disabled
vec2pt = Vector2Pt(PointA=item, PointB=ins_2, Unitize=False)  # -> Vector, Length; disabled
crossref = CrossReference(ListA=ins, ListB=vec2pt.Vector, CrossMode=1)  # -> ListA, ListB; disabled
move = Move(Geometry=crossref.ListA, Motion=crossref.ListB)  # -> Geometry, Transform; disabled
ins_3 = InsertItems(List=move.Geometry, Item=ins, Indices=0, Wrap=True)  # disabled
lng_3 = ListLength(List=ins)  # disabled
c_script = CSharpScript(x=ins_3, y=lng_3)  # -> flatten(A), flatten(B); inputs x: list of Point3d, y: Int32; disabled
# ---------- c_script: C# ----------
    List<Polyline> panels = new List<Polyline>();
    List<string> panelsNames = new List<string>();

    int k = x.Count - y - 1;

    for (int i = 0; i < k; i++)
    {
      int a = i + 1;
      if (a % y != 0)
      {
        panels.Add(Panel(x, i, y));

      }
    }

    for (int i = 0; i < panels.Count; i++)
    {
      panelsNames.Add(PanelData(panels[i]));
    }

    A = panels;
    B = panelsNames;
# ---------- c_script: C# additional code ----------
  public Polyline Panel(List < Point3d > pointList, int i, int y)
  {
    List<Point3d> pList = new List<Point3d>() {
        pointList[i],
        pointList[i + 1],
        pointList[i + y + 1],
        pointList[i + y],
        pointList[i]
        };

    Polyline pl = new Polyline(pList);

    return pl;
  }

  public string PanelData(Polyline pl)
  {
    double ba = pl[0].DistanceTo(pl[1]);
    double he = pl[1].DistanceTo(pl[2]);

    string item = Math.Round(ba, 0).ToString() + '-' + Math.Round(he, 0).ToString();
    return item;
  }
# ---------- end c_script ----------
txt = Text(c_script.B)  # disabled

# ---- group: Polylines
geo_2 = Geometry(c_script.A)  # disabled

# ----
panel_2 = Panel("%")  # disabled
python = GhPythonScript(x=c_script.B)  # -> a, b; inputs x: list; disabled
# ---------- python: Python ----------
__author__ = "riccardo"
__version__ = "2023.02.16"

import rhinoscriptsyntax as rs

list = []

for i in range(len(x)):
    a = x[i].split('-')
    list.append([float(a[0]),float(a[1]),x[i],i])

list = sorted(list, key = lambda x: (x[0], x[1]))

archive = [list[0][2]]

for i in range(1, len(x)):
    if (list[i][2] != list[i-1][2]):
        archive.append(list[i][2])

a = list
b= archive
# ---------- end python ----------
concat = Concatenate(FragmentA=panel_2, FragmentB=txt)  # disabled
python_2 = GhPythonScript(x=python.a)  # -> simplify(a); disabled
# ---------- python_2: Python ----------
__author__ = "riccardo"
__version__ = "2023.02.16"

import rhinoscriptsyntax as rs

a = x
# ---------- end python_2 ----------
button = Button()  # disabled
area = Area(Geometry=geo_2)  # -> Area, Centroid; disabled
panel_3 = Panel("0.1")  # disabled
layers = CreateModifyLayers(LayerName=python.b, DeleteLayer=False, enableFullPath=False)  # -> LayerNames, LayerFullPath; disabled
qb = QuickBaker(Geometric=geo_2, Attribute=concat, Bake=False)  # disabled
textbaker = TextBaker(
    Location=area.Centroid,
    Text=txt,
    Size=panel_3,
    Attribute=concat,
    Justification=4,
    Bake=button,
    Dot_Text=False,
    Enable_Mask=True,
    On_Screen=False)  # disabled
