# Grasshopper definition AutoPanel2.gh (Grasshopper 1.0.7)
# plug-ins: ScriptParasite, EleFront, MetaHopper, Heteroptera, Human

# Ordine dei Layers da Rhino:
# 
# 'dir'   => PARENT LAYER
# -------------------
# > 'dir-border-h'  => 1 LINEA (BORDO H)
# > 'dir-border-v'  => 1 LINEA (BORDO V)
# 
# > 'dir-h-x.x'     => N LINEE (FUGHE H)
# > ...
# > 'dir-v-x.x'     => N LINEE (FUGHE V)
# > ...
# -------------------
# 
# 'obs'   => PARENT LAYER
# -------------------
# > obs-[...]       => N POLILINEE (OSTACOLI)
# > ...
# -------------------
counter = Counter()
panel = Panel("""Librerie aggiuntive:
Elefront
Human
MetaHopper
Heteroptera""")

panel_2 = Panel("CONTROLLO MANUALE LAYERS")
panel_3 = Panel("""dir-border-h
dir-border-v
dir-h-2.2
dir-h-8.8
dir-v-8.8
dir-b-8.8.5.5""")

panel_4 = Panel("""obs-windows
obs-detach
obs-pavement
obs-other""")
reflay = ReferenceByLayer(LayerName=panel_4)  # -> simplify(Geometry)

reflay_2 = ReferenceByLayer(LayerName=panel_3)

# ---- group: H-V
c_script = CSharpScript(y=reflay_2)  # -> B, A; inputs y: tree of Polyline
# ---------- c_script: C# ----------
    Polyline h = (Polyline) y.Branch(0)[0];
    Polyline v = (Polyline) y.Branch(1)[0];

    bool a = false;

    double Y = h.PointAt(1).Y - h.PointAt(0).Y;
    double X = v.PointAt(1).X - v.PointAt(0).X;

    if ( Y != 0 || X != 0) a = true;

    if (a)
    {
      B = "200,50,50"; //RED
      A = "H o V non sono ortogonali";
    }
    else
    {
      B = "50,200,50"; //GREEN
      A = " ";
    }
# ---------- end c_script ----------
panel_5 = Panel(c_script.A)

# ----
merge = Merge(Data1=graft(panel_3), Data2=reflay_2)  # -> simplify(Result)
setpanel = SetPanelProperties(Panel=null, Color=c_script.B, AllObjects_Object=panel_5)

# ---- group: LAYER NAMES
c_script_2 = CSharpScript(y=merge)  # -> B, A; inputs y: tree
# ---------- c_script_2: C# ----------
    var a = (string) y.Branch(0)[0];
    var b = (string) y.Branch(1)[0];

    bool c = false;

    if ( a != "dir-border-h" || b != "dir-border-v") c = true;

    if (c)
    {
      B = "200,50,50";
      A = "Problema con i due layer di bordo";
    }
    else 
    {
      B = "50,200,50";
      A = " ";
    }
# ---------- end c_script_2 ----------
panel_6 = Panel(c_script_2.A)

# ----
setpanel_2 = SetPanelProperties(Panel=null, Color=c_script_2.B, AllObjects_Object=panel_6)

# ---- group: LAYER NAMES
c_script_3 = CSharpScript(y=merge)  # -> B, A; inputs y: tree
# ---------- c_script_3: C# ----------
    List<string> list = new List<string>();

    for (int i = 2; i < y.BranchCount; i++)
    {
      string k = y.Branch(i)[0].ToString().Split('-')[1];
      list.Add(k);
    }

    bool c = false;

    foreach (string i in list)
      if ( i != "h" && i != "v" && i != "b") c = true;

    if (c)
    {
      B = "200,50,50"; // RED
      A = "Problema di nomenclatura con i layer delle griglie";
    }
    else
    {
      B = "50,200,50"; // GREEN
      A = " ";
    }
# ---------- end c_script_3 ----------
panel_7 = Panel(c_script_3.A)

# ----
setpanel_3 = SetPanelProperties(Panel=null, Color=c_script_3.B, AllObjects_Object=panel_7)

# ---- group: GENERATOR
c_script_4 = CSharpScript(x=merge, y=reflay)  # -> pl, layerNames, names, archive, freeTag, export, PanelC41; inputs x: tree, y: tree
# ---------- c_script_4: C# usings ----------
using Rhino.Geometry.Intersect;
using System.Linq;
using Rhino.DocObjects;
# ---------- c_script_4: C# ----------
    grid = new Grid(x, y);
    panelC41s = grid.panels;

    pl = grid.Plines(panelC41s);
    layerNames = grid.TypeTags(panelC41s);
    names = grid.NameTags(panelC41s);
    archive = ArchiveTypes(panelC41s);
    freeTag = grid.FreeTag(panelC41s);
    export = grid.toExport(panelC41s);
    PanelC41 = panelC41s;
# ---------- c_script_4: C# additional code ----------
  // fields
  public Grid grid;
  public List<PanelC41> panelC41s;

  public List<string> archive;

  public class Grid
  {
    public DataTree<object> param;
    public DataTree<Polyline> obs;

    // tutte le coordinate delle fughe in X e Y
    public List<double> xCoordinates;
    public List<double> yCoordinates;

    public List<PanelC41> panels;
    public List<Point3d> pts;

    public Grid(DataTree<object> x, DataTree<object> y)
    {
      param = x;

      obs = new DataTree<Polyline>();

      for (int i = 0; i < y.BranchCount; i++)
      { obs.AddRange(y.Branch(i).Select(pl => (PolylineCurve)pl).ToList().Select(pl => pl.ToPolyline()).ToList(), new GH_Path(i)); }

      OrderLines(param);

      pts = new List<Point3d>();

      panels = Panels(xCoordinates, yCoordinates);

      OrderOutput(panels);

      PostPanels(panels);
    }

    public void OrderLines(DataTree<object> param)
    {
      List<double> xtmp = new List<double>();
      List<double> ytmp = new List<double>();

      // param.BranchCount - 1 perch� l'ultimo branch sono i bordi esterni
      for (int i = 2; i < param.BranchCount - 1; i++)
      {
        int fuga = (int)Convert.ToInt64(param.Branch(i)[0].ToString().Split('-')[2].ToString().Split('.')[0]);
        string dir = param.Branch(i)[0].ToString().Split('-')[1];

        List<double> tmp = new List<double>();

        if (dir == "h")
        {
          // start at j = 1 perchè la prima linea è il nome del layer 
          for (int j = 1; j < param.Branch(i).Count; j++)
          {
            PolylineCurve tmpPl = (PolylineCurve)param.Branch(i)[j];
            tmp.Add(tmpPl.PointAt(0).Y - fuga);
            tmp.Add(tmpPl.PointAt(0).Y + fuga);
          }

          ytmp.AddRange(tmp);
        }

        else if (dir == "v")
        {
          // start at j = 1 perchè la prima linea è il nome del layer
          for (int j = 1; j < param.Branch(i).Count; j++)
          {
            PolylineCurve tmpPl = (PolylineCurve)param.Branch(i)[j];
            tmp.Add(tmpPl.PointAt(0).X - fuga);
            tmp.Add(tmpPl.PointAt(0).X + fuga);
          }

          xtmp.AddRange(tmp);
        }
      }

      xtmp.Sort();
      ytmp.Sort();

      xCoordinates = xtmp;
      yCoordinates = ytmp;

      Borders(param);
    }

    public void OrderOutput(List<PanelC41> panels)
    {
      List<PanelC41> tmp = panels.OrderBy(a => a.firstCorner[0]).ThenBy(b => b.firstCorner[1]).ToList();

      this.panels.Clear();

      this.panels.AddRange(tmp);
    }

    void PostPanels(List<PanelC41> panels)
    {
      for (int i = 0; i < panels.Count - 1; i++)
      {
        if (panels[i].type == "B" || panels[i].type == "B*C")
        {
          if (panels[i + 1].type == "C") panels[i + 1].type = "D*C";
          else panels[i + 1].type = "D";
        }
      }
    }

    public List<PanelC41> Panels(List<double> xCoordinates, List<double> yCoordinates)
    {
      List<PanelC41> panels = new List<PanelC41>();

      for (int i = 0; i < yCoordinates.Count; i += 2)
      {
        for (int j = 0; j < xCoordinates.Count; j += 2)
        {
          var points = new List<Point3d>
            {
              new Point3d(xCoordinates[j], yCoordinates[i], 0),
              new Point3d(xCoordinates[j + 1], yCoordinates[i], 0),
              new Point3d(xCoordinates[j + 1], yCoordinates[i + 1], 0),
              new Point3d(xCoordinates[j], yCoordinates[i + 1], 0),
              new Point3d(xCoordinates[j], yCoordinates[i], 0)
              };

          pts.AddRange(points.GetRange(0, 4));

          PanelC41 tmpPanel = new PanelC41(points, obs);
          if (!tmpPanel.crossed) panels.Add(tmpPanel);
        }
      }

      return panels;
    }

    public List<Polyline> Plines(List<PanelC41> panels)
    {
      List<Polyline> polylines = panels.Select(i => i.pl).ToList();

      return polylines;
    }

    public List<bool> FreeTag(List<PanelC41> panels)
    {
      List<bool> freeTag = panels.Select(i => i.crossed).ToList();

      return freeTag;
    }

    public List<string> DimensionsTags(List<PanelC41> panels)
    {
      List<string> nameTags = panels.Select(i => i.name).ToList();

      return nameTags;
    }

    public List<string> NameTags(List<PanelC41> panels)
    {
      List<string> names = panels.Select(i => i.type).ToList();
      for (int i = 0; i < panels.Count; i++)
      {
        names[i] = names[i] + "|" + panels[i].name;
      }

      return names;
    }

    public List<string> TypeTags(List<PanelC41> panels)
    {
      List<string> types = panels.Select(i => i.type).ToList();

      return types;
    }

    public List<string> toExport(List<PanelC41> panels)
    {
      List<string> export = panels.Select(i => i.toExcel).ToList();
      export.Insert(0, "Type,Width,Heigh,Marca");

      return export;
    }

    void Borders(DataTree<object> param)
    {
      int[] fughe = param.Branch(param.BranchCount - 1)[0].ToString().Split('-')[2].Split('.').Select(element => Convert.ToInt32(element)).ToArray();

      PolylineCurve curve = (PolylineCurve)param.Branch(param.BranchCount - 1)[1];

      double[] x = new double[4];
      double[] y = new double[4];

      for (int i = 0; i < 4; i++)
      {
        x[i] = curve.Point(i).X;
        y[i] = curve.Point(i).Y;
      }

      yCoordinates.Insert(0, Math.Round(y.Min() + fughe[0]));
      xCoordinates.Insert(xCoordinates.Count, Math.Round(x.Max() - fughe[1]));
      yCoordinates.Insert(yCoordinates.Count, Math.Round(y.Max() - fughe[2]));
      xCoordinates.Insert(0, Math.Round(x.Min() + fughe[3]));
    }
  }

  public class PanelC41
  {
    //fields
    public double width;
    public double height;
    public double borderUp;
    public double borderDown;
    public double hookUp;
    public double hookDown;

    public Polyline pl;
    public bool crossed;
    public string type;
    public string name;
    public double[] firstCorner = new double[2];

    public string toExcel;

    //Constructor
    public PanelC41(List<Point3d> list, DataTree<Polyline> obs)
    {
      borderUp = 1;
      borderDown = 2;
      hookUp = 3;
      hookDown = 4;
      type = "A";

      crossed = false;

      pl = new Polyline(list);
      firstCorner[0] = pl[0].X;
      firstCorner[1] = pl[0].Y;

      int[] i = Intercept(obs);

      if (i[0] >= 0)
      {
        crossed = InterceptedPanelVertical(obs.Branch(0), i[0], 8);
      }
      if (i[1] >= 0)
      {
        crossed = InterceptedPanelHorizontal(obs.Branch(2), i[1], 8);
      }

      Name();
      Detached(obs.Branch(1));
      InterceptedPanelVarious(obs.Branch(3));

      toExcel = type + "," + width.ToString() + "," + height.ToString() +
        "," + type + "." + width.ToString() + "." + height.ToString();
    }

    public void Name()
    {
      width = Math.Round(pl[0].DistanceTo(pl[1]));
      height = Math.Round(pl[1].DistanceTo(pl[2]));
      name = width.ToString() + '-' + height.ToString();
    }

    public int[] Intercept(DataTree<Polyline> obs)
    {
      // ora non funziona per ostacoli multipli che intersecano oggetti

      int counter = 0;
      int b = -1;
      int c = -1;

      for (int i = 0; i < obs.Branch(0).Count; i++)
      {
        var tmp = Intersection.CurveCurve(pl.ToPolylineCurve(), obs.Branch(0)[i].ToPolylineCurve(), 0.1, 0.1).Count;
        counter += tmp;
        if (tmp != 0) b = i;
      }

      for (int i = 0; i < obs.Branch(2).Count; i++)
      {
        var tmp = Intersection.CurveCurve(pl.ToPolylineCurve(), obs.Branch(2)[i].ToPolylineCurve(), 0.1, 0.1).Count;
        counter += tmp;
        if (tmp != 0) c = i;
      }

      if (counter == 0) crossed = false;
      else crossed = true;
      return new int[] { b, c };
    }

    public bool InterceptedPanelVertical(List<Polyline> obs, int i, double fuga)
    {
      // Funziona solo per finestre centrate sui pannelli
      // Viene considerata solo la Y quindi

      double[] yObs = new double[] { obs[i][0].Y, obs[i][1].Y, obs[i][2].Y };
      double[] y = new double[] { pl[0].Y, pl[1].Y, pl[2].Y };

      if (yObs.Max() >= y.Max() && yObs.Min() <= y.Min())
      {
        return true;
      }
      else if (y.Max() > yObs.Max())
      {
        double newY = yObs.Max();
        List<Point3d> tmp = new List<Point3d>()
        {
          new Point3d(pl[0].X, newY + fuga,0),
          new Point3d(pl[1].X, newY+ fuga,0),
          new Point3d(pl[2]),
          new Point3d(pl[3]),
          new Point3d(pl[4].X, newY+ fuga,0),
        };

        pl = new Polyline(tmp);
        return false;
      }
      else if (y.Min() < yObs.Min())
      {
        double newY = yObs.Min();
        List<Point3d> tmp = new List<Point3d>()
        {
          new Point3d(pl[0]),
          new Point3d(pl[1]),
          new Point3d(pl[2].X, newY - fuga,0),
          new Point3d(pl[3].X, newY - fuga,0),
          new Point3d(pl[4]),
        };

        pl = new Polyline(tmp);

        return false;
      }

      else { return false; }
    }

    public bool InterceptedPanelHorizontal(List<Polyline> obs, int i, double fuga)
    {
      // Funziona solo per rettangoli orizzontali centrati sui pannelli
      // Viene considerata solo la X quindi

      double[] xObs = new double[] { obs[i][0].X, obs[i][1].X, obs[i][2].X };
      double[] x = new double[] { pl[0].X, pl[1].X, pl[2].X };

      if (xObs.Max() >= x.Max() && xObs.Min() <= x.Min())
      {
        return true;
      }

      else if (x.Max() > xObs.Max())
      {
        double newX = xObs.Max();
        List<Point3d> tmp = new List<Point3d>()
        {
          new Point3d(newX + fuga, pl[0].Y, 0),
          new Point3d(pl[1]),
          new Point3d(pl[2]),
          new Point3d(newX + fuga, pl[3].Y,0 ),
          new Point3d(newX + fuga, pl[0].Y, 0)
        };

        pl = new Polyline(tmp);
        return false;
      }

      else if (x.Min() < xObs.Min())
      {
        double newX = xObs.Min();
        List<Point3d> tmp = new List<Point3d>()
        {
          new Point3d(pl[0]),
          new Point3d(newX - fuga, pl[1].Y, 0),
          new Point3d(newX - fuga, pl[2].Y, 0),
          new Point3d(pl[3]),
          new Point3d(pl[0])
        };

        pl = new Polyline(tmp);

        return false;
      }

      else { return false; }
    }

    public void InterceptedPanelVarious(List<Polyline> obs)
    {
      int counter = 0;

      double[] x = new double[] { pl[0].X, pl[1].X };
      double[] y = new double[] { pl[1].Y, pl[2].Y };

      for (int i = 0; i < obs.Count; i++)
      {
        // Pannelli intersecati da un ostacolo
        var tmp = Intersection.CurveCurve(pl.ToPolylineCurve(), obs[i].ToPolylineCurve(), 0.1, 0.1).Count;
        counter += tmp;

        double[] xObs = new double[] { obs[i][0].X, obs[i][1].X };
        double[] yObs = new double[] { obs[i][1].Y, obs[i][2].Y };

        // Pannelli C circondati
        if (xObs[1] > x[1] && x[0] > xObs[0] && yObs[1] > y[1] && y[0] > yObs[0])
        {
          counter++;
          crossed = true;
        }

        // Pannelli C con un foro
        if (xObs[1] < x[1] && x[0] < xObs[0] && yObs[1] < y[1] && y[0] < yObs[0]) counter++;
      }

      if (counter > 0)
      {
        if (type == "A") type = "C";
        else type += "*C";
      }
    }

    public void Detached(List<Polyline> det)
    {
      // Per ogni Line di intersezione 

      int counter = 0;

      for (int i = 0; i < det.Count; i++)
      {
        var tmp = Intersection.CurveCurve(pl.ToPolylineCurve(), det[i].ToPolylineCurve(), 0.1, 0.1).Count;
        counter += tmp;
      }

      if (counter != 0)
      {
        type = "B";
      }
    }
  }

  public List<string> ArchiveDimensions(List<PanelC41> panelC41s)
  {
    List<string> list;
    var orderedPanels = panelC41s.OrderBy(panelC41 => panelC41.width).ThenBy(panelC41 => panelC41.height);

    list = orderedPanels.Select(x => x.name).ToList();

    List<string> arc = new List<string> { list[0] };
    for (int i = 1; i < list.Count; i++)
    {
      if (list[i] != list[i - 1])
      {
        arc.Add(list[i]);
      }
    }

    return arc;
  }

  public List<string> ArchiveTypes(List<PanelC41> panelC41s)
  {
    List<string> list;
    var orderedPanels = panelC41s.OrderBy(panelC41 => panelC41.type);

    list = orderedPanels.Select(x => x.type).ToList();

    List<string> arc = new List<string> { list[0] };
    for (int i = 1; i < list.Count; i++)
    {
      if (list[i] != list[i - 1])
      {
        arc.Add(list[i]);
      }
    }

    return arc;
  }
# ---------- end c_script_4 ----------
scriptpar = ScriptParasite(Enable=True, Folder="C:\Users\riccardo\source\repos\GH_Develop\AutoPanel")

# ---- group: PANEL NAMES
c_script_5 = CSharpScript(x=c_script_4.layerNames, y=c_script_4.names, z=c_script_4.PanelC41)  # -> B, A, C; inputs x: list of String, y: list of String, z: list
# ---------- c_script_5: C# ----------
    if (x.Count == y.Count && y.Count == z.Count)
    {
      List<string> k = new List<string>();
      
      bool c = false;

      for (int i = 0; i < x.Count; i++)
      {
        if (x[i] != y[i].Split('|')[0]) c = true;
        
        k.Add(x[i] + y[i].Split('|')[0]);
      }

      if (c)
      {
        B = "200,50,50"; // RED
        A = "Problema di nomenclatura dei pannelli";
      }
      else
      {
        B = "50,200,50"; // GREEN
        A = " ";
      }
      
      C = k;      
    }
    else
    {
      B = "200,50,50"; // RED
      A = "Le tre liste non hanno lo stesso numero di oggetti";
    }
# ---------- end c_script_5 ----------
panel_8 = Panel(c_script_5.A)

# ----
setpanel_4 = SetPanelProperties(Panel=null, Color=c_script_5.B, AllObjects_Object=panel_8)

# ---- group: HATCH COLORS
swatch = ColourSwatch(SwatchColor=RGB(242, 68, 68))
swatch_2 = ColourSwatch(SwatchColor=RGB(100, 217, 121))
swatch_3 = ColourSwatch(SwatchColor=RGB(224, 151, 61))
swatch_4 = ColourSwatch(SwatchColor=RGB(227, 208, 61))
swatch_5 = ColourSwatch(SwatchColor=RGB(82, 137, 227))
swatch_6 = ColourSwatch(SwatchColor=RGB(186, 77, 219))
panel_9 = Panel(c_script_4.archive)

# ---- group: PRODUCTION CHECK
c_script_6 = CSharpScript(x=c_script_4.pl, y=c_script_4.names)  # -> A; inputs x: list of Polyline, y: list of String
# ---------- c_script_6: C# usings ----------
using System.Linq;
# ---------- c_script_6: C# ----------
    alert.Clear();

    if (x.Count == y.Count)
    {
      for (int i = 0; i < x.Count; i++)
      {
        Check(x[i], y[i]);
      }
    }

    A = alert;
# ---------- c_script_6: C# additional code ----------
  // START CODE

  List<Point3d> alert = new List<Point3d>();

  public void Check(Polyline pl, string name)
  {
    string type = name.Split('|')[0];
    double len;
    double tolerance;

    if (type == "A")
    {
      tolerance = 90;
      len = pl[0].DistanceTo(pl[1]);
      double test = len + tolerance;

      if (test > 1250)
      {
        alert.Add(new Point3d(pl.BoundingBox.Center));
      }
    }
  }

  // END CODE
# ---------- end c_script_6 ----------
scriptpar_2 = ScriptParasite(Enable=True, Folder="C:\Users\riccardo\source\repos\GH_Develop\AutoPanel")

# ---- group: PRODUCTION
pt = Point(c_script_6)
cir = Circle(Plane=pt, Radius=100)

# ----
bake_hatch_colors = Button()
bake_hatch_grey = Button()
panel_10 = Panel("BAKING STATION")
bake_polylines = Button()
bake_texts = Button()

# ---- group: ACTIVATE BAKING
toggle = BooleanToggle(False)

# ---- group: VIEW
toggle_2 = BooleanToggle(True)

# ---- group: XLS
xlsx = Button()
f_ghfilepath = GHFilePathInfo()  # -> F, P
# ---------- f_ghfilepath: C# ----------
                                      /*
    froGH - a sparse collection of (in)utilities for Grasshopper

    GH File and Path info

    code by Alessio Erioli

    froGH by Co-de-iT is licensed under a Creative Commons Attribution 4.0 International License.
    http://creativecommons.org/licenses/by/4.0/

    */

    initComp();

    GH_Document ghDoc = Grasshopper.Instances.ActiveCanvas.Document;

    int nameLen = ghDoc.DisplayName.TrimEnd('*').Length + 3; // +3 accounts for the '.gh' extension
    int fileLen = ghDoc.FilePath.TrimEnd('*').Length;

    F = ghDoc.DisplayName.TrimEnd('*');
    P = ghDoc.FilePath.Substring(0, fileLen - nameLen);
# ---------- f_ghfilepath: C# additional code ----------
  void initComp(){

    Component.Name = "GH File Path Info";
    Component.NickName = "f_GHFilePath";
    Component.Description = "Provides info on current Grasshopper Document file name and path\nUseful for exporting files with the same name as the gh file and in the same directory";
    Component.Params.Output[0].Name = "File Name";
    Component.Params.Output[0].Description = "Current GH file name";
    Component.Params.Output[1].Name = "File Path";
    Component.Params.Output[1].Description = "Current GH file path";
  }
# ---------- end f_ghfilepath ----------
python = GhPythonScript(x=f_ghfilepath.P, y=c_script_4.export, z=xlsx)  # -> out, a; inputs y: list, z: Boolean
# ---------- python: Python ----------
__author__ = "riccardo"
__version__ = "2023.02.23"

import os
import rhinoscriptsyntax as rs

def Database():
    # Get Path in the document
    filePathXlsx = os.path.join(x, 'database' + '.xlsx')
    
    txt = ''
    
    for i in y:
        txt += i
        txt += '\n'
    
    #Write to .xlsx
    file = open(filePathXlsx, "w")
    file.write(txt[0:len(txt)-1])
    file.close()
    
    return txt

if (z):
    a = Database()
# ---------- end python ----------

# ---- group: WIRE DISPLAY
list = ValueList({"def": 0, "fai": 1, "hid": 2}, selected="hid")

# ----
wiredisplay = ControlWireDisplay(
    WireDisplay=list,
    AllObjects_Object=[c_script_4, geo, preview, cluster_2, qb, area, panel_11, textbaker, python_2, textbaker_2, layers, python, panel_12, cluster, cluster_3, python_3, c_script_6])
onoff = EnableDisableObject(Enabled=toggle, AllObjects_Object=[qb, textbaker, layers, cluster, cluster_3])
hideshow = HideShowObjectPreview(Visible=toggle_2, AllObjects_Object=[preview, textbaker_2])

area = Area(Geometry=c_script_4.pl)  # -> Area, Centroid
panel_11 = Panel("100")
panel_12 = Panel("%text")

# ---- group: POLYLINES
python_2 = GhPythonScript(x=c_script_4.layerNames)  # -> a
# ---------- python_2: Python ----------
__author__ = "riccardo"
__version__ = "2023.02.21"

import rhinoscriptsyntax as rs

a = '%' + x
# ---------- end python_2 ----------
qb = QuickBaker(Geometric=c_script_4.pl, Attribute=python_2, Bake=bake_polylines)  # disabled

# ---- group: LAYERS
python_3 = GhPythonScript(x=c_script_4.archive)  # -> a; inputs x: list
# ---------- python_3: Python ----------
__author__ = "riccardo"
__version__ = "2023.02.24"

import rhinoscriptsyntax as rs

x.append('hatch_grey')
x.append('hatch_colors')

a = x
# ---------- end python_3 ----------
layers = CreateModifyLayers(LayerName=python_3, DeleteLayer=False, enableFullPath=False)  # -> LayerNames, LayerFullPath; disabled

# ---- group: TEXT-BAKE
textbaker = TextBaker(
    Location=area.Centroid,
    Text=c_script_4.names,
    Size=panel_11,
    Attribute=panel_12,
    Justification=4,
    Bake=bake_texts,
    Dot_Text=False,
    Enable_Mask=True,
    On_Screen=False)  # disabled

# ---- group: HATCH GREY
cluster = Cluster_2(B=bake_hatch_grey, C=c_script_4.pl)  # disabled

# ---- group: TEXT-DISPLAY
textbaker_2 = TextBaker(
    Location=area.Centroid,
    Text=c_script_4.names,
    Size=panel_11,
    Justification=4,
    Bake=False,
    Dot_Text=False,
    Enable_Mask=True,
    On_Screen=False)

# ---- group: OBSTACLE COLORS
cluster_2 = Cluster(x=c_script_4.freeTag)
geo = Geometry(c_script_4.pl)
preview = CustomPreview(Geometry=geo, Material=cluster_2)

# ---- group: HATCH COLORS
cluster_3 = Cluster_3(
    B=bake_hatch_colors,
    x=c_script_4.layerNames,
    C=c_script_4.pl,
    _0=swatch,
    _1=swatch_2,
    _2=swatch_3,
    _3=swatch_4,
    _4=swatch_5,
    _5=swatch_6)  # disabled

# ==== cluster Cluster
x = ClusterInput()
python = GhPythonScript(x=x)  # -> a
# ---------- python: Python ----------
__author__ = "riccardo"
__version__ = "2023.02.21"

import rhinoscriptsyntax as rs

if (x == False):
    a = '63,232,232'
else:
    a = '230,37,232'
# ---------- end python ----------
material = CreateMaterial(Diffuse=python, Specular=RGB(255, 255, 255), Emission=RGB(0, 0, 0), Transparency=0, Shine=0)
M = ClusterOutput(material)

# ==== cluster Counter
button = Button()
button_2 = Button()
_0 = Button()
c_script = CSharpScript(x=button, y=button_2, z=_0)  # -> A; inputs x: Boolean, y: Boolean, z: Boolean
# ---------- c_script: C# ----------
    if(x) a++;
    if(y) a--;
    if (z) a = 0;

    A = a;
# ---------- c_script: C# additional code ----------
  int a = 0;
# ---------- end c_script ----------

# ==== cluster Cluster_2
B = ClusterInput()
C = ClusterInput()
createatts = CreateAttributes(LayerName="hatch_grey", Color=ColourSwatch(SwatchColor=RGB(181, 181, 181)), enableFullPath=False)
createhatch = CreateHatch(Bake=B, Curves=C, HatchPatternName="Solid", HatchScale=1, HatchRotation=0, Attributes=createatts)  # -> HatchGeometry, HatchObjects

# ==== cluster Cluster_3
_0 = ClusterInput()
_1 = ClusterInput()
_2 = ClusterInput()
_3 = ClusterInput()
_4 = ClusterInput()
_5 = ClusterInput()
x = ClusterInput()
B = ClusterInput()
C = ClusterInput()
python = GhPythonScript(x=x)  # -> graft(a); inputs x: list
# ---------- python: Python ----------
__author__ = "riccardo"
__version__ = "2023.02.24"

import rhinoscriptsyntax as rs

list = []

for i in x:
    if (i == 'A'):
        list.append(0)
    if (i == 'B'):
        list.append(1)
    if (i == 'B*C'):
        list.append(2)
    if (i == 'C'):
        list.append(3)
    if (i == 'D'):
        list.append(4)
    if (i == 'D*C'):
        list.append(5)

a = list
# ---------- end python ----------
weave = Weave(Pattern=python, Stream0=_0, Stream1=_1, Stream2=_2, Stream3=_3, Stream4=_4, Stream5=_5, NullGaps=False)  # -> flatten(Weave)
createatts = CreateAttributes(LayerName="hatch_colors", Color=weave, enableFullPath=False)
createhatch = CreateHatch(Bake=B, Curves=C, HatchPatternName="Solid", HatchScale=1, HatchRotation=0, Attributes=createatts)  # -> HatchGeometry, HatchObjects
