# Grasshopper definition AutoPanel3.gh (Grasshopper 1.0.7)
# plug-ins: Heteroptera, ScriptParasite, EleFront, MetaHopper, Human, froGH

# Ordine dei Layers da Rhino:
# 
# 'dir'   => PARENT LAYER
# -------------------
# > 'dir-nb-border'  => 1 POLILINEA (BORDO)
# 
# > 'dir-nh-x.x'     => N LINEE (FUGHE H)
# > ...
# > 'dir-nv-x.x'     => N LINEE (FUGHE V)
# > ...
# > obs-n[...]       => N POLILINEE (OSTACOLI)
# > ...
# -------------------
panel = Panel("""Librerie aggiuntive:
Elefront
Human
MetaHopper
Heteroptera""")
counter = Counter()
layertable = LayerTable(Update=Button(), AutoUpdate=False)  # -> Layers, FullLayerPaths, LayerColors, Linetypes, MaterialNames, Visible, PrintWidth, PrintColor
python = GhPythonScript(x=layertable.Layers)  # -> flatten(a), flatten(b), flatten(c); inputs x: list
# ---------- python: Python ----------
__author__ = "riccardo"
__version__ = "2023.02.27"

import rhinoscriptsyntax as rs

list = []
list2 = []
list3 = []

for i in x:
    if (i.split('-')[0] == 'dir'):
        list.append(i)
    if (i.split('-')[0] == 'obs'):
        list2.append(i)
    if (i.split('-')[0] == 'sec'):
        list3.append(i)
list.sort()

a = list
b = list2
c=list3
# ---------- end python ----------
panel_2 = Panel(python.a)
panel_3 = Panel(python.b)
panel_4 = Panel(python.c)
f_ghfilepath = GHFilePathInfo()  # -> FileName, FilePath
python_2 = GhPythonScript(x=f_ghfilepath.FilePath)  # -> a
# ---------- python_2: Python ----------
__author__ = "riccardo"
__version__ = "2023.03.13"

import rhinoscriptsyntax as rs
a = x + 'manual.txt'
# ---------- end python_2 ----------
f_urlr = ReadFileFromURL(URLAddress=python_2, ByLine=False)
panel_5 = Panel(f_urlr)

panel_6 = Panel("""dir-0b-border
dir-0h-8.8
dir-0v-2.2
dir-1b-border
dir-1h-8.8
dir-1v-2.2
dir-2b-border
dir-2h-8.8
dir-2v-2.2
dir-3b-border
dir-3h-8.8
dir-3v-2.2
dir-4b-border
dir-4h-8.8
dir-4v-2.2
dir-5b-border
dir-5h-8.8
dir-5v-2.2
dir-6b-border
dir-6h-8.8
dir-6v-2.2
dir-7b-border
dir-7h-8.8
dir-7v-2.2
dir-8b-border
dir-8h-8.8
dir-8v-2.2
dir-9b-border
dir-9h-8.8
dir-9v-2.2
dir-10b-border
dir-10h-8.8
dir-10v-2.2
dir-11b-border
dir-11h-8.8
dir-11v-2.2
dir-12b-border
dir-12h-8.8
dir-12v-2.2
dir-13b-border
dir-13h-8.8
dir-13v-2.2
dir-14b-border
dir-14h-8.8
dir-14v-2.2
dir-15b-border
dir-15h-8.8
dir-15v-2.2
dir-16b-border
dir-16h-8.8
dir-16v-2.2
dir-17b-border
dir-17h-8.8
dir-17v-2.2
dir-18b-border
dir-18h-8.8
dir-18v-2.2
dir-18v-0.0
dir-19b-border
dir-19h-8.8
dir-19v-2.2
dir-19v-0.0""")
panel_7 = Panel("CONTROLLO MANUALE LAYERS")

panel_8 = Panel("""obs-0windows
obs-0detach
obs-0pavement
obs-0other
obs-0wall
obs-1windows
obs-1detach
obs-1pavement
obs-1other
obs-1wall
obs-2windows
obs-2detach
obs-2pavement
obs-2other
obs-2wall
obs-3windows
obs-3detach
obs-3pavement
obs-3other
obs-3wall
obs-4windows
obs-4detach
obs-4pavement
obs-4other
obs-4wall
obs-5windows
obs-5detach
obs-5pavement
obs-5other
obs-5wall
obs-6windows
obs-6detach
obs-6pavement
obs-6other
obs-6wall
obs-7windows
obs-7detach
obs-7pavement
obs-7other
obs-7wall
obs-8windows
obs-8detach
obs-8pavement
obs-8other
obs-8wall
obs-9windows
obs-9detach
obs-9pavement
obs-9other
obs-9wall
obs-10windows
obs-10detach
obs-10pavement
obs-10other
obs-10wall
obs-11windows
obs-11detach
obs-11pavement
obs-11other
obs-11wall
obs-12windows
obs-12detach
obs-12pavement
obs-12other
obs-12wall
obs-13windows
obs-13detach
obs-13pavement
obs-13other
obs-13wall
obs-14windows
obs-14detach
obs-14pavement
obs-14other
obs-14wall
obs-15windows
obs-15detach
obs-15pavement
obs-15other
obs-15wall
obs-16windows
obs-16detach
obs-16pavement
obs-16other
obs-16wall
obs-17windows
obs-17detach
obs-17pavement
obs-17other
obs-17wall
obs-18windows
obs-18detach
obs-18pavement
obs-18other
obs-18wall
obs-19windows
obs-19detach
obs-19pavement
obs-19other
obs-19wall""")
reflay = ReferenceByLayer(LayerName=panel_8)  # -> simplify(Geometry)

panel_9 = Panel("""sec-0
sec-1
sec-2
sec-3
sec-4
sec-5
sec-6
sec-7
sec-8
sec-9
sec-10
sec-11
sec-12
sec-13
sec-14
sec-15
sec-16
sec-17
sec-18
sec-19""")

reflay_2 = ReferenceByLayer(LayerName="baseline")  # -> simplify(Baseline)
reflay_3 = ReferenceByLayer(LayerName=panel_9)  # -> simplify(Geometry)
reflay_4 = ReferenceByLayer(LayerName="FILTER")  # -> simplify(FILTER)
reflay_5 = ReferenceByLayer(LayerName=panel_6)

merge = Merge(Data1=graft(panel_6), Data2=reflay_5)  # -> simplify(Result)

c_script = CSharpScript(x=merge, y=reflay, z=reflay_2, u=reflay_3)  # -> out, A, baselines, pl, layerNames, names, archive, export, exportTree, normalVectors; inputs x: tree, y: tree, z: list of Polyline, u: tree
# ---------- c_script: C# usings ----------
using Rhino.Geometry.Intersect;
using System.Linq;
using Rhino.DocObjects;
using Rhino.UI.Controls;
using Grasshopper.Kernel.Types.Transforms;
using System.Diagnostics;
using Rhino.UI;
using Rhino.Render.ChangeQueue;
using System.ComponentModel;
using System.Drawing.Printing;
using System.Text;
using System.Text.RegularExpressions;
using System.Windows.Forms;
using System.Linq.Expressions;
using System.Threading;
# ---------- c_script: C# ----------
    Stopwatch sw = Stopwatch.StartNew();
    sw.Start();


    facade = new Facade(x, y, z, u);

    panelC41s = new List<PanelC41>();
    plines = new DataTree<Polyline>();
    this.archive = new List<string>();
    this.names = new DataTree<string>();
    types = new DataTree<string>();
    toExport = new List<string> { "Type,Width,Heigh,Marca,Facciata,Tin,TinH,Sec" };
    toExportTree = new DataTree<string>();
    normals = new List<Vector3d>();

    foreach (Grid3d grid in facade.grids)
    {
      int i = facade.grids.IndexOf(grid);
      panelC41s.AddRange(grid.panels);
      plines.AddRange(grid.Plines(grid.panels), new GH_Path(i));
      types.AddRange(grid.TypeTags(grid.panels), new GH_Path(i));
      this.names.AddRange(grid.NameTags(grid.panels), new GH_Path(i));
      toExport.AddRange(grid.ToExport(grid.panels));
      toExportTree.AddRange(grid.ToExport(grid.panels), new GH_Path(i));
      normals.Add(grid.normal);
    }

    this.archive.AddRange(ArchiveTypes(panelC41s));

    A = facade.angles;
    baselines = facade.baseLines;
    pl = plines;
    layerNames = types;
    names = this.names;
    archive = this.archive;
    export = toExport;
    exportTree = toExportTree;
    normalVectors = normals;

    sw.Stop();
    //MessageBox.Show(sw.ElapsedMilliseconds.ToString());
# ---------- c_script: C# additional code ----------
  // fields
  public Facade facade;
  public List<PanelC41> panelC41s;
  public DataTree<Polyline> plines;
  public DataTree<string> names;
  public DataTree<string> types;
  public List<string> toExport;
  public DataTree<string> toExportTree;
  public List<Vector3d> normals;

  public List<string> archive;

  public class Facade
  {
    //fields
    public List<Grid3d> grids;
    public List<Point3d> points;
    public List<double> angles;
    public List<Polyline> baseLines;

    public int cCount;

    //DELETE
    public List<int> ints;

    //contructor
    public Facade(DataTree<object> input, DataTree<object> obs, List<Polyline> baseline, DataTree<object> sec)
    {
      grids = new List<Grid3d>();
      cCount = 0;

      // counter = [3, 3, 3]
      var counter = FacadeCount(input);
      var pointer = 0;

      // Angles
      FillAngles(baseline);

      // Populate Datatrees for Grids
      for (int i = 0; i < counter.Count; i++)
      {
        DataTree<object> tmp = new DataTree<object>();
        DataTree<object> tmpObs = new DataTree<object>();
        var count = 0;

        for (int j = pointer; j < pointer + counter[i]; j++)
        {
          tmp.AddRange(input.Branch(j), new GH_Path(count)); count++;
        }
        pointer += counter[i];

        var k = i * 5;
        count = 0;
        for (int j = k; j < k + 5; j++)
        {
          tmpObs.AddRange(obs.Branch(j), new GH_Path(count));
          count++;
        }

        Grid3d tmpGrid = new Grid3d(tmp, tmpObs, baseLines[i]);
        grids.Add(tmpGrid);
      }

      // Left Border, Right Border, Name Uniformation and Sec
      PostPanels(grids, sec);

      // Uniform panelC41.ToExport
      CorrectExport();
    }

    public List<int> FacadeCount(DataTree<object> input)
    {
      List<int> k = new List<int> { 1 };
      List<double> compare = new List<double>();

      for (int i = 0; i < input.BranchCount; i++)
      {
        string tmp = input.Branch(i)[0].ToString().Split('-')[1];
        double a = int.Parse(tmp.Substring(0, tmp.Length - 1));
        //double a = char.GetNumericValue(input.Branch(i)[0].ToString().Split('-')[1][0]);
        compare.Add(a);
      }
      // k = [1]
      // compare = [0,0,0,1,1,1,2,2,2]

      for (int i = 1; i < compare.Count; i++)
      {
        if (compare[i] == compare[i - 1]) k[k.Count - 1]++;
        else k.Add(1);
      }

      // k = [3,3,3]
      ints = k;
      return k;
    }

    public void FillAngles(List<Polyline> baseline)
    {
      baseLines = new List<Polyline>();
      angles = new List<double>();

      foreach (Polyline p in baseline)
      {
        angles.Add(2 * Math.PI);

        for (int i = 1; i < p.Count - 1; i++)
        {
          baseLines.Add(new Polyline(new List<Point3d> { p[i - 1], p[i] }));
          Vector3d normal = Vector3d.CrossProduct(new Vector3d(p[i] - p[i - 1]), new Vector3d(0, 0, 1));

          if (Intersection.CurveCurve(new Line(p[i - 1], p[i + 1]).ToNurbsCurve(),
            new Line(p[i], normal, 100000).ToNurbsCurve(), 0.1, 0.1).Count > 0)
          {
            angles.AddRange(Enumerable.Repeat(Vector3d.VectorAngle(new Vector3d(p[i - 1] - p[i]), new Vector3d(p[i + 1] - p[i])), 2));
          }
          else
          {
            angles.AddRange(Enumerable.Repeat(2 * Math.PI - Vector3d.VectorAngle(new Vector3d(p[i - 1] - p[i]), new Vector3d(p[i + 1] - p[i])), 2));
          }
        }
        baseLines.Add(new Polyline(new List<Point3d> { p[p.Count - 2], p[p.Count - 1] }));

        angles.Add(2 * Math.PI);
      }
    }

    public void PostPanels(List<Grid3d> grid, DataTree<object> sec)
    {
      int fugaMax = 16;
      int tracker = 0;

      for (int j = 0; j < grid.Count; j++)
      {
        List<Polyline> secs = sec.Branch(j).Select(p => (PolylineCurve) p).ToList().Select(pp => pp.ToPolyline()).ToList();

        for (int i = 0; i < grid[j].panels.Count; i++)
        {
          double l = new Point3d(grid[j].panels[i].pl[0].X, grid[j].panels[i].pl[0].Y, 0).DistanceTo(new Point3d(grid[j].border[0].X, grid[j].border[0].Y, 0));
          double r = new Point3d(grid[j].panels[i].pl[1].X, grid[j].panels[i].pl[1].Y, 0).DistanceTo(new Point3d(grid[j].border[1].X, grid[j].border[1].Y, 0));

          // LEFT
          if (Math.Abs(l) < fugaMax)
          {
            var nn = BorderPanelName(grids.IndexOf(grid[j]), 0);
            if (grid[j].panels[i].type.Contains('F') || grid[j].panels[i].type.Contains('E'))
            {
              grid[j].panels[i].type = grid[j].panels[i].type.Replace("E", "K");
            }

            else { grid[j].panels[i].type = grid[j].panels[i].type.Replace("A", nn); }
          }

          // RIGHT
          if (Math.Abs(r) < fugaMax)
          {
            var nn = BorderPanelName(grids.IndexOf(grid[j]), 1);
            if (grid[j].panels[i].type.Contains('E') || grid[j].panels[i].type.Contains('F'))
            {
              grid[j].panels[i].type = grid[j].panels[i].type.Replace("E", "K");
            }

            else { grid[j].panels[i].type = grid[j].panels[i].type.Replace("A", nn); }
          }

          // C Tracker
          if (grid[j].panels[i].type.Contains("C"))
          {
            grid[j].panels[i].cCount = tracker;
            tracker++;
          }

          // Name correction (B*C)
          //REPLACE B=S
          if (grid[j].panels[i].type.Contains("C*S"))
          {
            grid[j].panels[i].type = grid[j].panels[i].type.Replace("C*S", "S*C");
          }

          // SEC
          PanelSec(grid[j].panels[i], secs);

          // REDUCTION
          BorderPanelReduction(grid[j].panels[i], j);

          // Name correction (*B*B)
          //REPLACE B=S
          int t = grid[j].panels[i].type.Count(k => k == 'S');
          if (t > 1)
          {
            grid[j].panels[i].type = grid[j].panels[i].type.Replace("*S", "");
            grid[j].panels[i].type += "*S";
          }

          // 20230630 cambia per il foro
          if (grid[j].panels[i].tinH != 0)
          {
            grid[j].panels[i].type += "*B";
          }
        }
      }
    }

    public string BorderPanelName(int i, int a)
    {
      double angle = angles[(2 * i) + a];

      if (angle == 2 * Math.PI)
      {
        if (a == 0) return "E";
        else return "F";
      }
        // I and J Panels
      else if (grids[i].monopanel)
      {
        angle = (180 / Math.PI) * angle;
        angle = (360 - angle) / 2;
        //REPLACE '.'='-'
        if (a == 0) return "J" + "-" + Math.Round(angle).ToString();
        else return "I" + "-" + Math.Round(angle).ToString();
      }
      else
      {
        angle = (180 / Math.PI) * angle;
        angle = (360 - angle) / 2;
        //REPLACE '.'='-'
        if (a == 0) return "H" + "-" + Math.Round(angle).ToString();
        else return "G" + "-" + Math.Round(angle).ToString();
      }
    }

    public void BorderPanelReduction(PanelC41 panel, int gridIndex)
    {
      Point3d p = new Point3d();

      var reduce = new Action<PanelC41, int, int>((panelPass, reduction, leftRight) =>
        {
        Point3d tmpPoint = panel.pl[leftRight];
        Circle c = new Circle(tmpPoint, reduction);

        var events = Intersection.CurveCurve(panel.pl.ToNurbsCurve(), c.ToNurbsCurve(), 0.01, 0.01);

        p = new Point3d(events[0].PointA);

        });

      //REPLACE '.'='-'
      if (panel.type.Contains('-'))
      {
        string[] keys = new string[] { "G", "H", "I", "J" };

        string sKeyResult = keys.FirstOrDefault<string>(s => panel.type.Contains(s));

        switch (sKeyResult)
        {
          case "G":
          case "I":

            double angle = angles[gridIndex * 2 + 1];
            angle = (180 / Math.PI) * angle;
            angle = (360 - angle) / 2;

            if (Math.Abs(angle - 45) > 0.1 && /*angle > 0 && angle < 90*/ Math.Abs(angle - 45) < 45)
            {
              reduce(panel, 12, 1);

              List<Point3d> list = new List<Point3d>
                {
                  panel.pl[0],
                  p,
                  new Point3d(p.X, p.Y, panel.pl[2].Z),
                  panel.pl[3],
                  panel.pl[0]
                  };

              panel.pl = new Polyline(list);
            }
            else if (Math.Abs(angle - 45) < 0.1)
            {
              reduce(panel, 10, 1);

              List<Point3d> list = new List<Point3d>
                {
                  panel.pl[0],
                  p,
                  new Point3d(p.X, p.Y, panel.pl[2].Z),
                  panel.pl[3],
                  panel.pl[0]
                  };

              panel.pl = new Polyline(list);
            }

            break;

          case "H":
          case "J":

            double angle2 = angles[gridIndex * 2];
            angle2 = (180 / Math.PI) * angle2;
            angle2 = (360 - angle2) / 2;

            if (Math.Abs(angle2 - 45) > 0.1 && /*angle2 > 0 && angle2 < 90*/ Math.Abs(angle2 - 45) < 45)
            {
              reduce(panel, 12, 0);

              List<Point3d> list = new List<Point3d>
                {
                  p,
                  panel.pl[1],
                  panel.pl[2],
                  new Point3d(p.X, p.Y, panel.pl[3].Z),
                  p
                  };

              panel.pl = new Polyline(list);
            }
            else if (Math.Abs(angle2 - 45) < 0.1)
            {
              reduce(panel, 10, 0);

              List<Point3d> list = new List<Point3d>
                {
                  p,
                  panel.pl[1],
                  panel.pl[2],
                  new Point3d(p.X, p.Y, panel.pl[3].Z),
                  p
                  };

              panel.pl = new Polyline(list);
            }

            break;

          default:
            break;
        }

        //Test
        if (panel.tin != 0) { panel.tin = Math.Round(panel.pl[1].DistanceTo(panel.pl[0])); }
      }
    }

    public void PanelSec(PanelC41 panel, List<Polyline> pls)
    {
      foreach (Polyline pl in pls)
      {
        var tmp = Intersection.CurveCurve(pl.ToPolylineCurve(), panel.pl.ToPolylineCurve(), 0.1, 0.1);

        if (tmp.Count != 0)
        {
          panel.sec = Math.Round(panel.pl[0].DistanceTo(tmp[0].PointA));
          panel.tinH = panel.height - 6;
        }
      }
    }

    public void CorrectExport()
    {
      foreach (Grid3d grid in grids)
      {
        int a = grids.IndexOf(grid);
        foreach (PanelC41 p in grid.panels)
        {
          p.width = Math.Round(p.pl[0].DistanceTo(p.pl[1]));
          p.height = Math.Round(p.pl[1].DistanceTo(p.pl[2]));
          p.name = p.width.ToString() + '-' + p.height.ToString();

          p.toExcel = p.type + ","
            + p.width.ToString() + ","
            + p.height.ToString() + ","
            + p.type + "." + p.width.ToString() + "." + p.height.ToString() + ","
            + a.ToString() + ","
            + p.tin.ToString() + ","
            + p.tinH.ToString() + ","
            + p.sec.ToString();
        }
      }
    }
  }

  public class Grid3d
  {
    DataTree<object> param;
    public DataTree<Polyline> obs;

    public Polyline border;
    public Polyline height;
    public Vector3d normal;
    public Vector3d ax;

    // tutte le coordinate delle fughe in X e Z
    List<Point3d> pointCoordinates;
    List<double> zCoordinates;

    public List<PanelC41> panels;
    public List<Point3d> pts;

    // DELETE
    public bool monopanel;

    // Constructor
    public Grid3d(DataTree<object> x, DataTree<object> y, Polyline border)
    {
      param = x;
      obs = new DataTree<Polyline>();
      ax = new Vector3d(border[1] - border[0]);
      this.border = border;

      for (int i = 0; i < y.BranchCount; i++)
      { obs.AddRange(y.Branch(i).Select(pl => (PolylineCurve) pl).ToList().Select(pl => pl.ToPolyline()).ToList(), new GH_Path(i)); }

      Borders(x.Branch(0)[1], ax);

      OrderLines(param);

      pts = new List<Point3d>();

      panels = Panels(pointCoordinates, zCoordinates);

      OrderOutputH(panels);

      PostPanelsWindows(panels);

      OrderOutputV(panels);

      PostPanels(panels);
    }

    // Debug Constructor
    public Grid3d(DataTree<object> x, DataTree<object> y, Polyline border, int gridnumber)
    {
      param = x;
      obs = new DataTree<Polyline>();
      ax = new Vector3d(border[1] - border[0]);
      this.border = border;

      for (int i = 0; i < y.BranchCount; i++)
      { obs.AddRange(y.Branch(i).Select(pl => (PolylineCurve) pl).ToList().Select(pl => pl.ToPolyline()).ToList(), new GH_Path(i)); }

      Borders(x.Branch(0)[1], ax);

      OrderLines(param);

      pts = new List<Point3d>();

      panels = Panels(pointCoordinates, zCoordinates);

      //TEST
      OrderOutputH(panels);
      PostPanelsWindows(panels);
      //TEST

      OrderOutputV(panels);

      PostPanels(panels);

      //MessageBox.Show(gridnumber.ToString());
    }

    // Assegna height e normal
    public void Borders(object a, Vector3d vector)
    {
      PolylineCurve p = (PolylineCurve) a;
      Polyline tmpPl = p.ToPolyline();
      List<Point3d> list = tmpPl.Select(point => point).ToList();
      list.RemoveAt(list.Count - 1);
      list = list.OrderBy(point => point.Z).ToList();

      height = new Polyline(new List<Point3d> { border[0], new Point3d(border[0].X, border[0].Y, list[list.Count - 1].Z) });
      normal = Vector3d.CrossProduct(vector, new Vector3d(height[1] - height[0]));
    }

    // Crea Liste di coordinate dalle quali fare i pannelli
    public void OrderLines(DataTree<object> param)
    {
      int verticalPanelCount = 0;

      List<Point3d> ptmp = new List<Point3d>();
      List<double> ztmp = new List<double>();

      // i = 1 perché il primo è il bordo
      for (int i = 1; i < param.BranchCount; i++)
      {

        double fuga = Convert.ToInt64(param.Branch(i)[0].ToString().Split('-')[2].ToString().Split('.')[0]);
        if (fuga == 0) { fuga += 0.1; }
        string dirName = param.Branch(i)[0].ToString().Split('-')[1];
        char dir = dirName[dirName.Length - 1];

        List<Point3d> tmpP = new List<Point3d>();

        if (dir == 'h')
        {
          // start at j = 1 perchè la prima entry è il nome del layer
          for (int j = 1; j < param.Branch(i).Count; j++)
          {
            var k = param.Branch(i)[j] as PolylineCurve;

            if (k != null)
            {
              PolylineCurve tmpPl = (PolylineCurve) param.Branch(i)[j];
              ztmp.Add(tmpPl.PointAt(0).Z - fuga);
              ztmp.Add(tmpPl.PointAt(0).Z + fuga);
            }
            else
            {
              LineCurve tmpPl = (LineCurve) param.Branch(i)[j];
              ztmp.Add(tmpPl.PointAt(0).Z - fuga);
              ztmp.Add(tmpPl.PointAt(0).Z + fuga);
            }
          }
        }

        else if (dir == 'v')
        {
          verticalPanelCount += param.Branch(i).Count;

          // start at j = 1 perchè la prima entry è il nome del layer
          for (int j = 1; j < param.Branch(i).Count; j++)
          {
            var k = param.Branch(i)[j] as PolylineCurve;

            if (k != null)
            {
              PolylineCurve tmpPl = (PolylineCurve) param.Branch(i)[j];
              Point3d tmpPoint = tmpPl.PointAtStart;
              Point3d tp = new Point3d(tmpPl.PointAt(0).X, tmpPl.PointAt(0).Y, border.PointAt(0).Z);
              Circle c = new Circle(tp, fuga);
              var events = Intersection.CurveCurve(border.ToNurbsCurve(), c.ToNurbsCurve(), 0.01, 0.01);
              foreach (IntersectionEvent ie in events) { tmpP.Add(new Point3d(ie.PointA)); }
            }
            else
            {
              LineCurve tmpPl = (LineCurve) param.Branch(i)[j];
              Point3d tmpPoint = tmpPl.PointAt(0);
              Point3d tp = new Point3d(tmpPl.PointAt(0).X, tmpPl.PointAt(0).Y, border.PointAt(0).Z);
              Circle c = new Circle(tp, fuga);
              var events = Intersection.CurveCurve(border.ToNurbsCurve(), c.ToNurbsCurve(), 0.01, 0.01);
              foreach (IntersectionEvent ie in events) { tmpP.Add(new Point3d(ie.PointA)); }
            }
          }
        }

        ptmp.AddRange(tmpP);
      }

      // Sorting of Z coordinates
      ztmp.Sort();
      ztmp.RemoveAt(0);
      ztmp.RemoveAt(0);
      ztmp.RemoveAt(ztmp.Count - 1);
      ztmp.RemoveAt(ztmp.Count - 1);
      double[] t = new double[] { height[0].Z, height[1].Z };
      ztmp.Insert(0, t.Min());
      ztmp.Add(t.Max());
      //      MessageBox.Show(ztmp.Count.ToString());
      //      MessageBox.Show(ptmp.Count.ToString());

      zCoordinates = ztmp;

      ptmp = ptmp.OrderBy(point => point.DistanceTo(border[0])).ToList();
      ptmp.RemoveAt(0);
      ptmp.RemoveAt(ptmp.Count - 1);
      ptmp.AddRange(new List<Point3d> { border.PointAt(0), border.PointAt(1) });
      pointCoordinates = ptmp.OrderBy(point => point.DistanceTo(border[0])).ToList();

      if (verticalPanelCount > 2) monopanel = false;
      else monopanel = true;
    }

    public List<PanelC41> Panels(List<Point3d> pointCoordinates, List<double> zCoordinates)
    {
      List<PanelC41> panels = new List<PanelC41>();

      for (int i = 0; i < zCoordinates.Count; i += 2)
      {
        for (int j = 0; j < pointCoordinates.Count; j += 2)
        {
          var points = new List<Point3d> {
              new Point3d(pointCoordinates[j].X, pointCoordinates[j].Y, zCoordinates[i]),
              new Point3d(pointCoordinates[j + 1].X, pointCoordinates[j + 1].Y, zCoordinates[i]),
              new Point3d(pointCoordinates[j + 1].X, pointCoordinates[j + 1].Y, zCoordinates[i + 1]),
              new Point3d(pointCoordinates[j].X, pointCoordinates[j].Y, zCoordinates[i + 1]),
              new Point3d(pointCoordinates[j].X, pointCoordinates[j].Y, zCoordinates[i])
              };

          pts.AddRange(points.GetRange(0, 4));

          PanelC41 tmpPanel = new PanelC41(points, obs, border);
          //EDIT
          //if (!tmpPanel.crossed[1]) panels.Add(tmpPanel);
          if (!(tmpPanel.crossed[0] && tmpPanel.crossed[1])) panels.Add(tmpPanel);
        }
      }

      return panels;
    }

    public void OrderOutputV(List<PanelC41> panels)
    {
      List<PanelC41> tmp;

      tmp = panels.OrderBy(a => new Point3d(a.firstCorner.X, a.firstCorner.Y, 0).DistanceTo(border[0])).ThenBy(b => b.firstCorner.Z).ToList();

      this.panels.Clear();

      this.panels.AddRange(tmp);
    }

    public void OrderOutputH(List<PanelC41> panels)
    {
      List<PanelC41> tmp;

      tmp = panels.OrderBy(a => a.firstCorner.Z).ThenBy(b => new Point3d(b.firstCorner.X, b.firstCorner.Y, 0).DistanceTo(border[0])).ToList();

      this.panels.Clear();

      this.panels.AddRange(tmp);
    }

    void PostPanelsWindows(List<PanelC41> panels)
    {
      List<int> tmp = new List<int>();

      // panels[i] = Panel inside of windows
      for (int i = 1; i < panels.Count - 1; i++)
      {
        if (panels[i].crossed[0] == false && panels[i].crossed[1] == true)
        {
          if (!panels[i - 1].type.Contains('E'))
          {
            panels[i - 1].type = panels[i - 1].type.Replace('A', 'F');
            panels[i - 1].type += 'X';
          }
          else
          {
            panels[i - 1].type = panels[i - 1].type.Replace('E', 'K');
            panels[i - 1].type += 'X';
          }
          if (!panels[i + 1].type.Contains('F'))
          {
            panels[i + 1].type = panels[i + 1].type.Replace('A', 'E');
            panels[i + 1].type += 'Y';
          }
          else
          {
            panels[i + 1].type = panels[i + 1].type.Replace('F', 'K');
            panels[i + 1].type += 'Y';
          }
        }
      }
    }

    void PostPanels(List<PanelC41> panels)
    {
      List<int> tmp = new List<int>();

      // pavement up/down, windows up/down, side windows up/down
      for (int i = 1; i < panels.Count - 1; i++)
      {
        // pavement up/down
        if (panels[i].crossed[0] == true && panels[i].crossed[1] == false)
        {
          panels[i - 1].type += "*W";
          //REPLACE B=S
          panels[i + 1].type += "*S";

          if (panels[i].type.Contains("E") || panels[i].type.Contains("F") || panels[i].type.Contains("J") || panels[i].type.Contains("I") || panels[i].type.Contains("K"))
          {
            panels[i].crossed[0] = false;
          }
          else
          {
            tmp.Add(i);
          }
        }

        // windows up/down
        if (panels[i].crossed[0] == false && panels[i].crossed[1] == true)
        {
          // window NOT on the lower border
          if (Math.Abs(panels[i].pl[0].Z - border[0].Z) > 10)
          {
            panels[i - 1].type = panels[i - 1].type.Replace("A", "KZ");
          }

          // window NOT on the upper border
          if (Math.Abs(panels[i].pl[2].Z - height[1].Z) > 10)
          {
            panels[i + 1].type = panels[i + 1].type.Replace("A", "KZ");
          }

          tmp.Add(i);
        }

        // Left side of a window
        if (panels[i].type.Contains('X'))
        {
          // check not borderDown
          if (!(Math.Abs((panels[i].pl[0].Z - border[0].Z)) < 2))
          {
            if (!panels[i - 1].type.Contains('E'))
            {
              panels[i - 1].type = panels[i - 1].type.Replace('A', 'F');
            }
            else
            {
              panels[i - 1].type = panels[i - 1].type.Replace('E', 'K');
            }

            panels[i].type = panels[i].type.Replace("X", "");
          }
          // check not borderUp
          if (Math.Abs(panels[i].pl[2].Z - height[1].Z) > 2)
          {
            if (!panels[i + 1].type.Contains('E'))
            {
              panels[i + 1].type = panels[i + 1].type.Replace('A', 'F');
            }
            else
            {
              panels[i + 1].type = panels[i + 1].type.Replace('E', 'K');
            }

            panels[i].type = panels[i].type.Replace("X", "");
          }
        }

        // Right side of a window
        if (panels[i].type.Contains("Y"))
        {
          // check not borderDown
          if (Math.Abs(panels[i].pl[0].Z - border[0].Z) > 2)
          {
            if (!panels[i - 1].type.Contains('F'))
            {
              panels[i - 1].type = panels[i - 1].type.Replace('A', 'E');
            }
            else
            {
              panels[i - 1].type = panels[i - 1].type.Replace('F', 'K');
            }

            panels[i].type = panels[i].type.Replace("Y", "");
          }
          // check not borderUp
          if (Math.Abs(panels[i].pl[2].Z - height[1].Z) > 2)
          {
            if (!panels[i + 1].type.Contains('F'))
            {
              panels[i + 1].type = panels[i + 1].type.Replace('A', 'E');
            }
            else
            {
              panels[i + 1].type = panels[i + 1].type.Replace('F', 'K');
            }

            panels[i].type = panels[i].type.Replace("Y", "");
          }
        }
      }

      tmp = tmp.OrderByDescending(x => x).ToList();
      for (int i = 0; i < tmp.Count; i++)
      {
        panels.RemoveAt(tmp[i]);
      }

      // All panels
      for (int i = 0; i < panels.Count - 1; i++)
      {
        //REPLACE B=S
        if (panels[i].type.Contains('S'))
        {
          ///panels[i + 1].type += "*D";
          ///panels[i + 1].tin = panels[i + 1].width;

          panels[i].tin = panels[i].width;
          panels[i].toExcel += "," + panels[i].width.ToString();
        }
      }

      for (int i = 0; i < panels.Count; i++)
      {
        // W dai Pavement
        if (panels[i].type.Contains('W'))
        {
          //REPLACE B=S
          panels[i].type = panels[i].type.Replace('W', 'S');
        }

        ///if (panels[i].type.Contains('D'))
        ///{
        ///  panels[i].type = panels[i].type.Replace('D', 'B');
        ///}

        // Z dalle finestre
        if (panels[i].type.Contains('Z'))
        {
          //REPLACE B=S
          panels[i].type = panels[i].type.Replace("Z", "*S");
        }
      }

      // BorderUp and BorderDown
      for (int i = 0; i < panels.Count; i++)
      {
        //REPLACE B=S
        //BorderDown
        if (Math.Abs(panels[i].pl[0].Z - height[0].Z) < 0.01 && !panels[i].type.Contains('S'))
        {
          panels[i].type += "*S";
          panels[i].tin = panels[i].width;

          ///if (!panels[i + 1].type.Contains('B'))
          ///{
          ///  panels[i + 1].type += "*B";
          ///  panels[i + 1].tin = panels[i + 1].width;
          ///  panels[i + 1].toExcel += "," + panels[i + 1].width.ToString();
          ///}
        }

        //REPLACE B=S
        //BorderUp
        else if (Math.Abs(panels[i].pl[3].Z - height[1].Z) < 0.01 && !panels[i].type.Contains('S'))
        {
          panels[i].type += "*S";
          panels[i].tin = 0; //panels[i].width;
        }
      }
    }

    public List<Polyline> Plines(List<PanelC41> panels)
    {
      List<Polyline> polylines = panels.Select(i => i.pl).ToList();

      return polylines;
    }

    public List<string> NameTags(List<PanelC41> panels)
    {
      List<string> names = panels.Select(i => i.type).ToList();
      for (int i = 0; i < panels.Count; i++)
      {
        names[i] = names[i] + "|" + panels[i].name;
        if (panels[i].cCount != -1) names[i] += "/" + panels[i].cCount.ToString();
      }

      return names;
    }

    public List<string> TypeTags(List<PanelC41> panels)
    {
      //List<string> types = panels.Select(i => i.type.Split('.')[0]).ToList();
      List<string> types = new List<string>();
      foreach (PanelC41 panel in panels)
      {
        //REPLACE '.'='-'
        string[] type = panel.type.Split('-');
        var adding = type[0];

        //REPLACE B=S
        if (type.Length > 1 && type[1].Contains('S'))
        {
          adding += "*S";
        }
        if (type.Length > 1 && type[1].Contains('C'))
        {
          adding += "*C";
        }
        types.Add(adding);
      }

      return types;
    }

    public List<string> ToExport(List<PanelC41> panels)
    {
      List<string> export = panels.Select(i => i.toExcel).ToList();

      return export;
    }
  }

  public class PanelC41
  {
    //fields
    public double width;
    public double height;
    public double tin;
    public double tinH;
    public double sec;
    public int cCount;

    public Polyline pl;
    public bool[] crossed;
    public string type;
    public string name;
    public Point3d firstCorner;
    public Polyline border;
    public Vector3d ax;
    public Point3d gridOrigin;
    public Point3d gridOriginZ0;

    public string toExcel;

    //constructor
    public PanelC41(List<Point3d> list, DataTree<Polyline> obs, Polyline border)
    {
      type = "A";
      tin = 0;
      tinH = 0;
      sec = 0;
      cCount = -1;

      crossed = new bool[2] { false, false };

      pl = new Polyline(list);

      firstCorner = pl[0];

      ax = new Vector3d(border[1] - border[0]);
      gridOrigin = border[0];
      gridOriginZ0 = new Point3d(border[0].X, border[0].Y, 0);
      this.border = border;

      List<int> wall = InterceptedPanelWall(obs.Branch(4));

      // [0 = internal,
      // 1 = verticalInterception,
      // 2 = horizontalInteception,
      // 3 = corner]

      if (!wall.Contains(0))
      {
        List<int> i = Intercept(obs);

        if (i[0] != 0)
        {
          for (int j = 1; j < i[0] + 1; j++)
          {
            crossed = InterceptedPanelVertical(obs.Branch(0), i[j], 8);
          }
        }
        if (i[i[0] + 1] != 0)
        {
          for (int j = i[i[0] + 1] + 1; j < i.Count; j++)
          {
            crossed = InterceptedPanelHorizontal(obs.Branch(2), i[j], 8, false);
          }
        }
        for (int j = 0; j < wall.Count; j++)
        {
          if (wall[j] == 1)
          {
            crossed = InterceptedPanelVertical(obs.Branch(4), j, 0);
            //REPLACE B=S
            type = type.Replace('W', 'S');
            //Tin above obstacles //20230629
            tin = pl[1].DistanceTo(pl[0]);
          }
          if (wall[j] == 2) crossed = InterceptedPanelHorizontal(obs.Branch(4), j, 0, true);
        }
      }

      Name();
      Detached(obs.Branch(1));
      InterceptedPanelVarious(obs.Branch(3));

      toExcel = type + "," + width.ToString() + "," + height.ToString() +
        "," + type + "." + width.ToString() + "." + height.ToString();
    }

    public void Name()
    {
      width = Math.Round(pl[0].DistanceTo(pl[1]));
      height = Math.Round(pl[1].DistanceTo(pl[2]));
      name = width.ToString() + '-' + height.ToString();
    }

    public List<int> Intercept(DataTree<Polyline> obs)
    {
      // Intercept():
      // > plines that intesect the panel ==> var tmp
      // > plines that completely include the panel ==> var tmp2

      List<int> intercepted = new List<int>();
      intercepted.Add(0);

      // Branch(0) windows. Polylines centrate sul pannello verticalmente
      for (int i = 0; i < obs.Branch(0).Count; i++)
      {
        //var tmp = Intersection.CurveCurve(pl.ToPolylineCurve(), obs.Branch(0)[i].ToPolylineCurve(), 0.1, 0.1).Count;
        var tmp2 = GenericInterception(obs.Branch(0)[i]);

        //if (tmp != 0)
        if (tmp2)
        {
          intercepted.Add(i);
          intercepted[0]++;
        }
      }

      // Branch(2) pavements. Polylines centrate sul pannello orizzontalmente
      intercepted.Add(0);

      for (int i = 0; i < obs.Branch(2).Count; i++)
      {
        var tmp = Intersection.CurveCurve(pl.ToPolylineCurve(), obs.Branch(2)[i].ToPolylineCurve(), 0.1, 0.1).Count;

        if (tmp != 0)
        {
          intercepted.Add(i);
          intercepted[intercepted[0] + 1]++;
        }
      }

      // intercepted structure:
      //
      //   0  1  2  3  4  5  6
      //   |-----|  |--------|
      //
      // [ 2, 2, 5, 3, 0, 7, 9]
      //   ^  '  '  ^  '  '  '
      //
      //   pointer  pointer

      return intercepted;
    }

    public bool[] InterceptedPanelVertical(List<Polyline> obs, int i, double fuga)
    {
      // Funziona solo per finestre centrate sui pannelli
      // Viene considerata solo la Z quindi

      double[] zObs = new double[] { obs[i][0].Z, obs[i][1].Z, obs[i][2].Z };
      double[] z = new double[] { pl[0].Z, pl[1].Z, pl[2].Z };

      // pannelli interamente contenuti
      if (zObs.Max() >= z.Max() && zObs.Min() <= z.Min())
      {
        return new bool[] { false, true };
      }
        //pannelli intersecati sotto
      else if (z.Max() > zObs.Max())
      {
        double newZ = zObs.Max();
        List<Point3d> tmp = new List<Point3d>()
          {
            new Point3d(pl[0].X, pl[0].Y, newZ + fuga),
            new Point3d(pl[1].X, pl[1].Y, newZ + fuga),
            new Point3d(pl[2]),
            new Point3d(pl[3]),
            new Point3d(pl[4].X, pl[4].Y, newZ + fuga),
            };

        pl = new Polyline(tmp);
        if (!type.Contains('W')) type += "*W";
        return new bool[] { false, false };
      }
        //pannelli intersecati sopra
      else if (z.Min() < zObs.Min())
      {
        double newZ = zObs.Min();
        List<Point3d> tmp = new List<Point3d>()
          {
            new Point3d(pl[0]),
            new Point3d(pl[1]),
            new Point3d(pl[2].X, pl[2].Y, newZ - fuga),
            new Point3d(pl[3].X, pl[3].Y, newZ - fuga),
            new Point3d(pl[4]),
            };

        pl = new Polyline(tmp);
        if (!type.Contains('W')) type += "*W";
        return new bool[] { false, false };
      }

      else { return new bool[] { false, false }; }
    }

    public bool[] InterceptedPanelHorizontal(List<Polyline> obs, int i, double fuga, bool wall)
    {
      // wall = true: rettangoli alti più di un pannello
      // wall = false: per rettangoli orizzontali centrati sui pannelli
      // Viene considerata solo distanza X-Y

      List<Point3d> p = new List<Point3d> { pl[0], pl[1] };

      List<Point3d> pObs = obs[i].Select(point => point).ToList();
      pObs.RemoveAt(pObs.Count - 1);
      pObs = pObs.OrderBy(point => point.Z).ToList();
      double[] zObs = new double[] { pObs[0].Z, pObs[3].Z };
      pObs.RemoveRange(2, 2);
      pObs = pObs.OrderBy(point => new Point3d(point.X, point.Y, 0).DistanceTo(gridOriginZ0)).ToList();

      // "leftObs" è un controllo per i cornicioni, cominciano a dx o a sx
      bool leftObs = new Point3d(pObs[0].X, pObs[0].Y, 0).DistanceTo(gridOriginZ0) < 0.01;
      // Right
      bool a = new Point3d(pl[1].X, pl[1].Y, 0).DistanceTo(gridOriginZ0) > new Point3d(pObs[1].X, pObs[1].Y, 0).DistanceTo(gridOriginZ0);
      bool b = new Point3d(pObs[1].X, pObs[1].Y, 0).DistanceTo(gridOriginZ0) > new Point3d(pl[0].X, pl[0].Y, 0).DistanceTo(gridOriginZ0);
      // Left
      bool c = new Point3d(pl[1].X, pl[1].Y, 0).DistanceTo(gridOriginZ0) > new Point3d(pObs[0].X, pObs[0].Y, 0).DistanceTo(gridOriginZ0);
      bool d = new Point3d(pObs[0].X, pObs[0].Y, 0).DistanceTo(gridOriginZ0) > new Point3d(pl[0].X, pl[0].Y, 0).DistanceTo(gridOriginZ0);

      if (wall)
      {
        if (c && d)
        {
          List<Point3d> tmp = new List<Point3d>()
            {
              new Point3d(pl[0]),
              new Point3d(pObs[0].X, pObs[0].Y, pl[1].Z),
              new Point3d(pObs[0].X, pObs[0].Y, pl[2].Z),
              new Point3d(pl[3]),
              new Point3d(pl[4])
              };

          pl = new Polyline(tmp);

          if (new Point3d(p[0].X, p[0].Y, 0).DistanceTo(gridOriginZ0) <= 0.01) { type = type.Replace("A", "J"); }
          else type = type.Replace("A", "F");
        }
        else if (a && b)
        {
          List<Point3d> tmp = new List<Point3d>()
            {
              new Point3d(pObs[1].X, pObs[1].Y, pl[0].Z),
              new Point3d(pl[1]),
              new Point3d(pl[2]),
              new Point3d(pObs[1].X, pObs[1].Y, pl[3].Z),
              new Point3d(pObs[1].X, pObs[1].Y, pl[4].Z)
              };

          pl = new Polyline(tmp);
        }
      }
      else
      {
        if (!leftObs && (c && d))
        {
          List<Point3d> tmp = new List<Point3d>()
            {
              new Point3d(pl[0]),
              new Point3d(pObs[0].X, pObs[0].Y, pl[1].Z),
              new Point3d(pObs[0].X, pObs[0].Y, pl[2].Z),
              new Point3d(pl[3]),
              new Point3d(pl[4])
              };

          pl = new Polyline(tmp);

          if (new Point3d(p[0].X, p[0].Y, 0).DistanceTo(gridOriginZ0) <= 0.01) { type = type.Replace("A", "J"); }
          else type = type.Replace("A", "F");
        }
        else if (leftObs && a && b)
        {
          List<Point3d> tmp = new List<Point3d>()
            {
              new Point3d(pObs[1].X, pObs[1].Y, pl[0].Z),
              new Point3d(pl[1]),
              new Point3d(pl[2]),
              new Point3d(pObs[1].X, pObs[1].Y, pl[3].Z),
              new Point3d(pObs[1].X, pObs[1].Y, pl[4].Z)
              };

          pl = new Polyline(tmp);
        }
      }

      if (new Point3d(pl[1].X, pl[1].Y, 0).DistanceTo(new Point3d(border[1].X, border[1].Y, 0)) < 0.01) { type = type.Replace("A", "I"); }
      else type = type.Replace("A", "E");

      // wall = t: return [F,F] and keep the panel
      // wall = f: return [T,F] to name B panel (i+1), (i-1)
      if (wall) return new bool[] { false, false };
      else return new bool[] { true, false };
    }

    public void InterceptedPanelVarious(List<Polyline> obs)
    {
      double[] z = new double[] { pl[1].Z, pl[2].Z };
      int counter = 0;

      for (int i = 0; i < obs.Count; i++)
      {
        List<Point3d> pObs = new List<Point3d> { obs[i][0], obs[i][1], obs[i][2], obs[i][3] };
        pObs = pObs.OrderBy(point => point.Z).ToList();
        double[] zObs = pObs.GetRange(1, 2).Select(point => point.Z).ToArray();

        pObs.RemoveRange(2, 2);
        pObs = pObs.OrderBy(point => new Point3d(point.X, point.Y, 0).DistanceTo(gridOriginZ0)).ToList();

        // Pannelli intersecati da un ostacolo
        var tmp = Intersection.CurveCurve(pl.ToPolylineCurve(), obs[i].ToPolylineCurve(), 0.1, 0.1).Count;
        counter += tmp;

        // Pannelli C circondati
        bool panelIn = new Point3d(pObs[1].X, pObs[1].Y, 0).DistanceTo(gridOriginZ0) > new Point3d(pl[1].X, pl[1].Y, 0).DistanceTo(gridOriginZ0)
          && new Point3d(pObs[0].X, pObs[0].Y, 0).DistanceTo(gridOriginZ0) < new Point3d(pl[0].X, pl[0].Y, 0).DistanceTo(gridOriginZ0)
          && zObs[1] > z[1] && z[0] > zObs[0];
        if (panelIn)
        {
          counter++;
          crossed = new bool[] { true, true };
        }

        // Pannelli C con un foro
        bool panelOut = new Point3d(pObs[1].X, pObs[1].Y, 0).DistanceTo(gridOriginZ0) < new Point3d(pl[1].X, pl[1].Y, 0).DistanceTo(gridOriginZ0)
          && new Point3d(pObs[0].X, pObs[0].Y, 0).DistanceTo(gridOriginZ0) > new Point3d(pl[0].X, pl[0].Y, 0).DistanceTo(gridOriginZ0)
          && zObs[1] < z[1] && z[0] < zObs[0];
        if (panelOut) counter++;
      }

      if (counter > 0)
      {
        type += "*C";
      }
    }

    public List<int> InterceptedPanelWall(List<Polyline> obs)
    {
      List<int> result = new List<int>();

      foreach (Polyline polyline in obs)
      {
        int i = obs.IndexOf(polyline);
        result.Add(-1);

        List<Point3d> pObs = polyline.Select(point => point).ToList();
        pObs.RemoveAt(pObs.Count - 1);
        pObs = pObs.OrderBy(point => point.Z).ToList();
        double[] zObs = new double[] { pObs[0].Z, pObs[3].Z };
        pObs.RemoveRange(2, 2);
        pObs = pObs.OrderBy(point => new Point3d(point.X, point.Y, 0).DistanceTo(gridOriginZ0)).ToList();

        bool horizontalIn = new Point3d(pObs[1].X, pObs[1].Y, 0).DistanceTo(gridOriginZ0) >= new Point3d(pl[1].X, pl[1].Y, 0).DistanceTo(gridOriginZ0)
          && new Point3d(pObs[0].X, pObs[0].Y, 0).DistanceTo(gridOriginZ0) <= new Point3d(pl[0].X, pl[0].Y, 0).DistanceTo(gridOriginZ0);
        bool verticalIn = zObs[1] >= pl[2].Z && zObs[0] <= pl[0].Z;

        bool verticalIntersection = (pl[2].Z > zObs[1] && zObs[1] > pl[0].Z) | (pl[2].Z > zObs[0] && zObs[0] > pl[0].Z);

        // Right
        bool a = new Point3d(pl[1].X, pl[1].Y, 0).DistanceTo(gridOriginZ0) > new Point3d(pObs[1].X, pObs[1].Y, 0).DistanceTo(gridOriginZ0);
        bool b = new Point3d(pObs[1].X, pObs[1].Y, 0).DistanceTo(gridOriginZ0) > new Point3d(pl[0].X, pl[0].Y, 0).DistanceTo(gridOriginZ0);
        // Left
        bool c = new Point3d(pl[1].X, pl[1].Y, 0).DistanceTo(gridOriginZ0) > new Point3d(pObs[0].X, pObs[0].Y, 0).DistanceTo(gridOriginZ0);
        bool d = new Point3d(pObs[0].X, pObs[0].Y, 0).DistanceTo(gridOriginZ0) > new Point3d(pl[0].X, pl[0].Y, 0).DistanceTo(gridOriginZ0);

        bool horizontalIntersection = (new Point3d(pl[1].X, pl[1].Y, 0).DistanceTo(gridOriginZ0) > new Point3d(pObs[1].X, pObs[1].Y, 0).DistanceTo(gridOriginZ0)
          && new Point3d(pObs[1].X, pObs[1].Y, 0).DistanceTo(gridOriginZ0) > new Point3d(pl[0].X, pl[0].Y, 0).DistanceTo(gridOriginZ0))
          | (new Point3d(pl[1].X, pl[1].Y, 0).DistanceTo(gridOriginZ0) > new Point3d(pObs[0].X, pObs[0].Y, 0).DistanceTo(gridOriginZ0)
          && new Point3d(pObs[0].X, pObs[0].Y, 0).DistanceTo(gridOriginZ0) > new Point3d(pl[0].X, pl[0].Y, 0).DistanceTo(gridOriginZ0)
          );

        //bool horizontalIntersection = (a && b) || (c && d);

        if (horizontalIn && verticalIn)
        {
          result[i] = 0;
          crossed = new bool[] { true, true };
        }
        else if (verticalIntersection && horizontalIn)
        {
          result[i] = 1;
        }
        else if (horizontalIntersection && verticalIn)
        {
          if (result[i] == -1)
          {
            result[i] = 2;
          }
        }
        else if (horizontalIntersection && verticalIntersection)
        {
          result[i] = 3;
          //REPLACE B=S
          type += "*S*C";
        }
      }

      return result;
    }

    public bool GenericInterception(Polyline obs)
    {
      bool ret = false;

      double[] z = new double[] { pl[1].Z, pl[2].Z };
      int counter = 0;

      List<Point3d> pObs = new List<Point3d> { obs[0], obs[1], obs[2], obs[3] };
      pObs = pObs.OrderBy(point => point.Z).ToList();
      double[] zObs = pObs.GetRange(1, 2).Select(point => point.Z).ToArray();

      pObs.RemoveRange(2, 2);
      pObs = pObs.OrderBy(point => new Point3d(point.X, point.Y, 0).DistanceTo(gridOriginZ0)).ToList();

      // Pannelli circondati
      bool panelIn = new Point3d(pObs[1].X, pObs[1].Y, 0).DistanceTo(gridOriginZ0) > new Point3d(pl[1].X, pl[1].Y, 0).DistanceTo(gridOriginZ0)
        && new Point3d(pObs[0].X, pObs[0].Y, 0).DistanceTo(gridOriginZ0) < new Point3d(pl[0].X, pl[0].Y, 0).DistanceTo(gridOriginZ0)
        && zObs[1] > z[1] && z[0] > zObs[0];

      if (panelIn)
      {
        counter++;
        ret = true;
      }

      return ret;
    }

    public void Detached(List<Polyline> det)
    {
      // Per ogni Line di intersezione
      int counter = 0;

      for (int i = 0; i < det.Count; i++)
      {
        var tmp = Intersection.CurveCurve(pl.ToPolylineCurve(), det[i].ToPolylineCurve(), 0.1, 0.1).Count;
        counter += tmp;
      }

      if (counter != 0)
      {
        // REPLACE B=S
        type += "*S";
      }
    }

  }

  public List<string> ArchiveTypesOld(List<PanelC41> panelC41s)
  {
    List<string> list;
    var orderedPanels = panelC41s.OrderBy(panelC41 => panelC41.type);

    list = orderedPanels.Select(x => x.type.Split('.')[0]).ToList();

    List<string> arc = new List<string> { list[0] };
    for (int i = 1; i < list.Count; i++)
    {
      if (list[i] != list[i - 1])
      {
        arc.Add(list[i]);
      }
    }

    return arc;
  }

  public List<string> ArchiveTypes(List<PanelC41> panelC41s)
  {
    //REPLACE '.'='-'
    List<string> list = panelC41s.Select(x => Regex.Replace(x.type, @"[\d-]", String.Empty)).ToList();

    list = list.Distinct().ToList();

    return list;
  }
# ---------- end c_script ----------
toggle = GroupToggle(ToggleActive=True, ToggleVisible=False)  # disabled

# ---- group: GENERATOR
scriptpar = ScriptParasite(Enable=True, Folder=f_ghfilepath.FilePath)

# ----
panel_10 = Panel(c_script.archive)

# ---- group: FILTER
c_script_2 = CSharpScript(containers=reflay_4, pl=c_script.pl, layerNames=c_script.layerNames, names=c_script.names, export=c_script.exportTree)  # -> out, A, B, C, D; inputs containers: Brep, pl: tree of Curve, layerNames: tree of String, names: tree of String, export: tree of String
# ---------- c_script_2: C# usings ----------
using System.Linq;
using Rhino.UI;
# ---------- c_script_2: C# ----------
    Check(containers, pl, layerNames, names, export);
    A = pl;
    B = layerNames;
    C = names;
    D = export;
# ---------- c_script_2: C# additional code ----------
  public void Check(Brep container, DataTree<Curve> pl, DataTree<string> layerNames, DataTree<string> names, DataTree<string> export)
  {
    for (int i = 0; i < pl.BranchCount; i++)
    {
      List<int> remove = new List<int>();
      for (int j = 0; j < pl.Branch(i).Count; j++)
      {
        bool inside = container.IsPointInside(pl.Branch(i)[j].GetBoundingBox(true).Center, 1, true);
        if (!inside)
        {
          remove.Add(j);
        }
      }

      remove = remove.OrderByDescending(x => x).ToList();

      for (int j = 0; j < remove.Count; j++)
      {
        pl.Branch(i).RemoveAt(remove[j]);
        layerNames.Branch(i).RemoveAt(remove[j]);
        names.Branch(i).RemoveAt(remove[j]);
        export.Branch(i).RemoveAt(remove[j]);
      }
    }
  }
# ---------- end c_script_2 ----------
scriptpar_2 = ScriptParasite(Enable=True, Folder=f_ghfilepath.FilePath)

# ---- group: FILTER 2
c_script_3 = CSharpScript(x=c_script_2.C, y=c_script.baselines, z=c_script.normalVectors)  # -> A, B; inputs x: tree, y: list of Polyline, z: list of Vector3d
# ---------- c_script_3: C# usings ----------
using System.Linq;
# ---------- c_script_3: C# ----------
    List<int> remove = new List<int>();

    for (int i = 0; i < x.BranchCount; i++)
    {
      if (x.Branch(i).Count == 0)
      {
        remove.Add(i);
      }
    }

    remove = remove.OrderByDescending(index => index).ToList();

    for (int j = 0; j < remove.Count; j++)
    {
      y.RemoveAt(remove[j]);
      z.RemoveAt(remove[j]);
    }

    A = y;
    B = z;
# ---------- end c_script_3 ----------
scriptpar_3 = ScriptParasite(Enable=True, Folder=f_ghfilepath.FilePath)

# ----
# Cleaning trees from filtered panels
list = ValueList({"TOTAL": 0, "FILTER": 1}, selected="FILTER")
filter = StreamFilter(Gate=list, Stream0=c_script.pl, Stream1=c_script_2.A)
filter_2 = StreamFilter(Gate=list, Stream0=c_script.layerNames, Stream1=c_script_2.B)
filter_3 = StreamFilter(Gate=list, Stream0=c_script.names, Stream1=c_script_2.C)
filter_4 = StreamFilter(Gate=list, Stream0=c_script.baselines, Stream1=c_script_3.A)
filter_5 = StreamFilter(Gate=list, Stream0=c_script.normalVectors, Stream1=c_script_3.B)
clean = CleanTree(RemoveNulls=False, RemoveInvalid=False, RemoveEmpty=True, Tree=filter)
clean_2 = CleanTree(RemoveNulls=False, RemoveInvalid=False, RemoveEmpty=True, Tree=filter_2)
clean_3 = CleanTree(RemoveNulls=False, RemoveInvalid=False, RemoveEmpty=True, Tree=filter_3)

# ---- group: PRODUCTION CHECK
c_script_4 = CSharpScript(x=clean, y=clean_3)  # -> A; inputs x: list of Polyline, y: list of String
# ---------- c_script_4: C# usings ----------
using System.Linq;
using System.Windows.Forms;
# ---------- c_script_4: C# ----------
    alert.Clear();

    if (x.Count == y.Count)
    {
      for (int i = 0; i < x.Count; i++)
      {
        Check(x[i], y[i]);
      }
    }

    A = alert;
# ---------- c_script_4: C# additional code ----------
  // START CODE

  List<Point3d> alert = new List<Point3d>();

  public void Check(Polyline pl, string name)
  {
    string type = name.Split('|')[0];
    double len;
    double tolerance;

    if (type.Contains('A'))
    {
      tolerance = 90;
      len = pl[0].DistanceTo(pl[1]);
      double test = len + tolerance;

      if (test > 1251)
      {
        alert.Add(new Point3d(pl.BoundingBox.Center));
      }
    }
  }

  // END CODE
# ---------- end c_script_4 ----------
scriptpar_4 = ScriptParasite(Enable=True, Folder=f_ghfilepath.FilePath)

# ---- group: XLS-TOTAL
xlsx = Button()
python_3 = GhPythonScript(x=f_ghfilepath.FilePath, y=c_script.export, z=xlsx)  # -> a; inputs y: list, z: Boolean
# ---------- python_3: Python ----------
__author__ = "riccardo"
__version__ = "2023.02.23"

import os
import rhinoscriptsyntax as rs

def Database():
    # Get Path in the document
    filePathXlsx = os.path.join(x, 'exp' + '\\' + 'database' + '.xlsx')
    
    txt = ''
    
    for i in y:
        txt += i
        txt += '\n'
    
    #Write to .xlsx
    file = open(filePathXlsx, "w")
    file.write(txt[0:len(txt)-1])
    file.close()
    
    return txt

if (z):
    a = Database()
# ---------- end python_3 ----------

# ---- group: PRODUCTION
sph = Sphere(Base=c_script_4, Radius=100)

# ----
grouped = BooleanToggle(True)
bake = BooleanToggle(False)

# ----
# PRIMA DI BAKE:
# 1. Sblocco layer:
#         > hatch_colors
#         > hatch_grey
#         > text
#         > pannelli
# 
# 2. BLOCCO ALTRI LAYER + current layer vuoto
# 
# 3. Activate baking
bake_hatch_colors = Button()
bake_hatch_grey = Button()
panel_11 = Panel("BAKE SINGLE OBJECT")
bake_polylines = Button()
bake_texts = Button()

python_4 = GhPythonScript(x=f_ghfilepath.FilePath)  # -> a
# ---------- python_4: Python ----------
__author__ = "riccardo"
__version__ = "2023.03.06"

import rhinoscriptsyntax as rs

a = x + 'exp'
# ---------- end python_4 ----------

# ---- group: VIEW
toggle_2 = BooleanToggle(True)

# ---- group: ACTIVATE BAKING
toggle_3 = BooleanToggle(False)

# ---- group: XLS-FILTERED
panel_12 = Panel("-Fase2-Lotto1")
xlsx_2 = Button()
python_5 = GhPythonScript(u=panel_12, x=f_ghfilepath.FilePath, y=c_script_2.D, z=xlsx_2)  # -> a; inputs y: tree, z: Boolean
# ---------- python_5: Python ----------
__author__ = "riccardo"
__version__ = "2023.02.23"

import os
import rhinoscriptsyntax as rs

def CheckType(k):
    typeWidthHeight = [k.split(',')[0],  k.split(',')[1], k.split(',')[2]]
    
    type = typeWidthHeight[0]
    wVista = typeWidthHeight[1]
    hVista = typeWidthHeight[2]
    wProd = 0
    hProd = 0
    emptyResult = 'WP,HP,AV,AP'
    
    if ('S' in typeWidthHeight[0]):
        if ('A' in typeWidthHeight[0] or 'G' in typeWidthHeight[0] or 'H' in typeWidthHeight[0]):
            
            wProd = int(wVista) + 40 + 40
            hProd = int(hVista) + 38 + 42
            
            areaVista = int(wVista) * int(hVista)
            areaProd = wProd * hProd
            
            return str(wProd) + ',' + str(hProd) + ',' + str(areaVista) + ',' + str(areaProd)
        
        elif('E' in typeWidthHeight[0] or 'F' in typeWidthHeight[0]):
            
            wProd = int(wVista) + 40 + 50 + 40 + 40
            hProd = int(hVista) + 38 + 42
            
            areaVista = int(wVista) * int(hVista)
            areaProd = areaProd = wProd * hProd
            
            return str(wProd) + ',' + str(hProd) + ',' + str(areaVista) + ',' + str(areaProd)
        
        elif('K' in typeWidthHeight[0]):
            
            wProd = int(wVista) + 40 + 50 + 40 + 40 + 50 + 40
            hProd = int(hVista) + 38 + 42
            
            areaVista = int(wVista) * int(hVista)
            areaProd = areaProd = wProd * hProd
            
            return str(wProd) + ',' + str(hProd) + ',' + str(areaVista) + ',' + str(areaProd)
        
        else:
            return emptyResult
    else:
        if ('A' in typeWidthHeight[0] or 'G' in typeWidthHeight[0] or 'H' in typeWidthHeight[0]):
            
            wProd = int(wVista) + 40 + 40
            hProd = int(hVista) + 38 + 42 + 47
            
            areaVista = int(wVista) * int(hVista)
            areaProd = wProd * hProd
            
            return str(wProd) + ',' + str(hProd) + ',' + str(areaVista) + ',' + str(areaProd)
        
        elif('E' in typeWidthHeight[0] or 'F' in typeWidthHeight[0]):
            
            wProd = int(wVista) + 40 + 50 + 40 + 40
            hProd = int(hVista) + 38 + 42 + 47
            
            areaVista = int(wVista) * int(hVista)
            areaProd = wProd * hProd
            
            return str(wProd) + ',' + str(hProd) + ',' + str(areaVista) + ',' + str(areaProd)
        
        elif('K' in typeWidthHeight[0]):
            
            wProd = int(wVista) + 40 + 50 + 40 + 40 +50 + 40
            hProd = int(hVista) + 38 + 42 + 47
            
            areaVista = int(wVista) * int(hVista)
            areaProd = wProd * hProd
            
            return str(wProd) + ',' + str(hProd) + ',' + str(areaVista) + ',' + str(areaProd)
        
        else:
            return emptyResult

def Database():
    
    txt = 'Type,Width,Heigh,Marca,Facciata,Tin,TinH,Sec,WidthProd,HeighProd,AreaVista,AreaProd' + '\n'
    
    for i in range(y.BranchCount):
        for j in y.Branch(i):
            add = CheckType(j)
            txt += j + ',' + add
            txt += '\n'
    
    return txt

def WriteDatabase(txt):
    # Get Path in the document
    filePathXlsx = os.path.join(x, 'exp' + '\\' + 'database-filtered' + str(u) + '.xlsx')
    
    #Write to .xlsx
    file = open(filePathXlsx, "w")
    file.write(txt[0:len(txt)-1])
    file.close()
    
    return 0

database = Database()

if (z):
    WriteDatabase(database)

a = database
# ---------- end python_5 ----------

# ----
hideshow = HideShowObjectPreview(Visible=toggle_2, AllObjects_Object=[preview, textbaker_3, textbaker])
onoff = EnableDisableObject(Enabled=toggle_3, AllObjects_Object=[qb, textbaker_2, layers, cluster, createhatch])

# ---- group: FACADE NAMES
c_script_5 = CSharpScript(tree=merge, normals=filter_5, baselines=filter_4)  # -> A, B; inputs tree: tree, normals: list of Vector3d, baselines: list of Vector3d
# ---------- c_script_5: C# ----------
    List<Point3d> list = new List<Point3d>();
    List<string> listt = new List<string>();
    List<Plane> listtt = new List<Plane>();

    for (int i = 0; i < tree.BranchCount; i++)
    {
      if (tree.Branch(i)[0].ToString().Contains("border"))
      {
        PolylineCurve p = (PolylineCurve) tree.Branch(i)[1];
        list.Add(p.GetBoundingBox(false).Center);
      }
    }

    for(int i = 0; i < list.Count; i++)
    {
      listt.Add(i.ToString());

      Vector3d binormal = Vector3d.CrossProduct(normals[i], baselines[i]);

      Plane p = new Plane(list[i], baselines[i], binormal);

      //      Plane p = new Plane(list[i], normals[i]);

      //      if (p.YAxis.Z < 0)
      //      {
      //        p.Rotate(Math.PI, p.ZAxis, p.Origin);
      //        listtt.Add(p);
      //      }
      //      else
      //      {}
      listtt.Add(p);

    }

    A = listtt;
    B = listt;
# ---------- end c_script_5 ----------
trigger = Trigger(Interval=10, TimerInterval=10, Target=c_script_6)  # disabled
c_script_6 = CSharpScript()  # -> out, A, B, C
# ---------- c_script_6: C# ----------
    int d = 2;
    a += d;
    b += d;
    c += d;

    A = Math.Abs((a % 510) - 255);
    B = Math.Abs((b % 510) - 255);
    C = Math.Abs((c % 510) - 255);
# ---------- c_script_6: C# additional code ----------
  int a = 0;
  int b = 85;
  int c = 170;
# ---------- end c_script_6 ----------
rgb = ColourRGB(Alpha=255, Red=c_script_6.A, Green=c_script_6.B, Blue=c_script_6.C)
textbaker = TextBaker(
    Location=c_script_5.A,
    Text=c_script_5.B,
    Size="200",
    Attribute=rgb,
    Justification=4,
    Bake=False,
    Dot_Text=False,
    Enable_Mask=True,
    On_Screen=False)

# ----
c_script_7 = CSharpScript(tree=clean, normals=filter_5, baselines=filter_4)  # -> A; inputs tree: tree of Polyline, normals: list of Vector3d, baselines: list of Vector3d
# ---------- c_script_7: C# ----------
    DataTree<Plane> planeTree = new DataTree<Plane>();


    for (int i = 0; i < tree.BranchCount; i++)
    {
      List<Point3d> list = new List<Point3d>();

      for (int j = 0; j < tree.Branch(i).Count; j++)
      {
        Polyline p = (Polyline) tree.Branch(i)[j];
        list.Add(p.CenterPoint());
      }

      Vector3d binormal = Vector3d.CrossProduct(normals[i], baselines[i]);
      planeTree.Add(new Plane(list[0], baselines[i], binormal), new GH_Path(i));

      for(int j = 1; j < list.Count; j++)
      {
        Plane p = new Plane(list[j], baselines[i], binormal);

        planeTree.Add(p);
      }
    }

    A = planeTree;
# ---------- end c_script_7 ----------

# ---- group: AUTOMATIC BAKE
c_script_8 = CSharpScript(
    grouped=grouped,
    groupedName="-Fase2-Lotto1",
    bake=bake,
    plines=clean,
    layerNames=clean_2,
    names=clean_3,
    textLocations=c_script_7,
    savingPath=python_4,
    baseLines=filter_4,
    pl=clean)  # -> out, A; inputs grouped: Boolean, groupedName: String, bake: Boolean, plines: tree of GeometryBase, layerNames: tree of String, names: tree of String, textLocations: tree of Plane, savingPath: String, baseLines: list of Polyline, pl: tree of Polyline
# ---------- c_script_8: C# usings ----------
using Rhino.Commands;
using Rhino.Display;
using System.Drawing;
using Rhino.DocObjects;
# ---------- c_script_8: C# ----------
    try
    {
      RhinoDoc doc = RhinoDoc.ActiveDoc;

      // TEXT ATTRIBUTE
      ObjectAttributes textAttribute = new ObjectAttributes();
      textAttribute.LayerIndex = doc.Layers.FindName("text").Index;

      // GREY HATCH ATTRIBUTE
      ObjectAttributes greyHatchesAtt = new ObjectAttributes();
      greyHatchesAtt.LayerIndex = doc.Layers.FindName("hatch_grey").Index;
      Color colorGray = Color.Gray;
      greyHatchesAtt.ObjectColor = colorGray;
      greyHatchesAtt.ColorSource = ObjectColorSource.ColorFromObject;

      if (bake)
      {
        ConstructionPlane cpOrigin = doc.Views.ActiveView.ActiveViewport.GetConstructionPlane();
        Point3d trackingOrigin = doc.Views.ActiveView.ActiveViewport.GetConstructionPlane().Plane.Origin;

        for (int i = 0; i < plines.BranchCount; i++)
        {
          if (grouped)
          {
            cpOrigin = new ConstructionPlane
              {
                Plane = new Plane(trackingOrigin, doc.Views.ActiveView.ActiveViewport.GetConstructionPlane().Plane.Normal)
                };

            trackingOrigin = new Point3d(trackingOrigin.X + baseLines[i].Length + 2000, trackingOrigin.Y, trackingOrigin.Z);
          }

          ConstructionPlane cp = new ConstructionPlane();
          Plane p = new Plane(baseLines[i][0], new Vector3d(baseLines[i][1] - baseLines[i][0]), new Vector3d(0, 0, 1));

          cp.Plane = p;

          Transform cb = Transform.PlaneToPlane(cp.Plane, cpOrigin.Plane);
          //doc.Views.ActiveView.ActiveViewport.SetConstructionPlane(cp);

          for (int j = 0; j < plines.Branch(i).Count; j++)
          {
            ObjectAttributes colorHatchesAtt = new ObjectAttributes();
            colorHatchesAtt.LayerIndex = doc.Layers.FindName("hatch_colors").Index;
            int[] tmp = ColorRB(layerNames.Branch(i)[j]);
            Color color = Color.FromArgb(tmp[0], tmp[1], tmp[2]);
            colorHatchesAtt.ObjectColor = color;
            colorHatchesAtt.ColorSource = ObjectColorSource.ColorFromObject;

            ObjectAttributes plineAtt = new ObjectAttributes();
            plineAtt.LayerIndex = doc.Layers.FindName(layerNames.Branch(i)[j]).Index;

            TextEntity t = new TextEntity
              {
                PlainText = names.Branch(i)[j],
                Plane = textLocations.Branch(i)[j],
                // 20230630
                TextHeight = 80,
                Justification = TextJustification.MiddleCenter
                };

            var a = plines.Branch(i)[j]; a.Transform(cb);
            var b = t; b.Transform(cb);

            var aa = pl.Branch(i)[j].ToPolylineCurve(); aa.Transform(cb);

            Hatch h = Hatch.Create(aa, 0, 0.0, 0.0, 0.0)[0];

            RhinoDocument.Objects.Add(a, plineAtt);
            RhinoDocument.Objects.Add(b, textAttribute);
            RhinoDocument.Objects.Add(h, greyHatchesAtt);
            RhinoDocument.Objects.Add(h, colorHatchesAtt);

          }

          if (!grouped)
          {
            RhinoApp.RunScript("-SelAll", false);
            string path = savingPath + "/" + i.ToString() + ".dwg";

            RhinoApp.RunScript("-Export " + path + " " + "Enter ", false);
            RhinoApp.RunScript("-SelAll", false);
            RhinoApp.RunScript("-Delete", false);
          }

          if (grouped)
          {
            TextEntity name = new TextEntity
              {
                PlainText = plines.Path(i).Indices[0].ToString(), // 20230630 i.ToString(),
                Justification = TextJustification.MiddleCenter,
                TextHeight = 500,
                Plane = new Plane(new Point3d(trackingOrigin.X - 2000 - (baseLines[i].Length * 0.5), trackingOrigin.Y - 2000, trackingOrigin.Z),
                cpOrigin.Plane.Normal)
                };

            RhinoDocument.Objects.Add(name, textAttribute);
          }
        }

        if (grouped)
        {
          RhinoApp.RunScript("-SelAll", false);
          string path = savingPath;
          if(groupedName.Length != 0)
          { path += "/" + "grouped" + groupedName + ".dwg";}
          else
          { path += "/" + "total" + ".dwg";}

          RhinoApp.RunScript("-Export " + path + " " + "Enter ", false);
          RhinoApp.RunScript("-SelAll", false);
          RhinoApp.RunScript("-Delete", false);
        }
      }

    }
    catch (Exception e)
    {
      Component.AddRuntimeMessage(GH_RuntimeMessageLevel.Error, e.StackTrace + e.Message);
      Print(e.StackTrace);
    }
# ---------- c_script_8: C# additional code ----------
  public int[] ColorRB(string layerName)
  {
    int[] k;

    if (layerName == "A")
    {
      k = new int[] { 242, 68, 68, 255 };
      return k;
    }
    else if (layerName.Contains("S"))
    {
      k = new int[] { 227, 208, 61, 255 };
      return k;
    }
    else if (layerName.Contains("K"))
    {
      k = new int[] { 0, 204, 102, 255 };
      return k;
    }
    else if (layerName == "E")
    {
      k = new int[] { 77, 200, 219, 255 };
      return k;
    }
    else if (layerName == "F")
    {
      k = new int[] { 174, 233, 242, 255 };
      return k;
    }
    else if (layerName == "G")
    {
      k = new int[] { 52, 140, 153, 255 };
      return k;
    }
    else if (layerName == "H")
    {
      k = new int[] { 10, 169, 194, 255 };
      return k;
    }
    else if (layerName == "J")
    {
      k = new int[] { 0, 116, 158, 255 };
      return k;
    }
    else if (layerName == "I")
    {
      k = new int[] { 0, 60, 69, 255 };
      return k;
    }
    else
    {
      k = new int[] { 242, 68, 68, 255 };
      return k;
    }
  }
# ---------- end c_script_8 ----------
scriptpar_5 = ScriptParasite(Enable=True, Folder=f_ghfilepath.FilePath)

# ---- group: POLYLINES
python_6 = GhPythonScript(x=clean_2)  # -> a
# ---------- python_6: Python ----------
__author__ = "riccardo"
__version__ = "2023.02.21"

import rhinoscriptsyntax as rs

a = '%' + x
# ---------- end python_6 ----------
qb = QuickBaker(Geometric=clean, Attribute=python_6, Bake=bake_polylines)  # disabled

# ---- group: LAYERS
python_7 = GhPythonScript(x=c_script.archive)  # -> a; inputs x: list
# ---------- python_7: Python ----------
__author__ = "riccardo"
__version__ = "2023.02.24"

import rhinoscriptsyntax as rs

#x.append('hatch_grey')
#x.append('hatch_colors')

a = x
# ---------- end python_7 ----------
layers = CreateModifyLayers(LayerName=python_7, DeleteLayer=False, enableFullPath=False)  # -> LayerNames, LayerFullPath; disabled

# ----
area = Area(Geometry=clean)  # -> Area, Centroid
pl = PlaneNormal(Origin=area.Centroid, ZAxis=graft(filter_5))
python_8 = GhPythonScript(x=pl)  # -> simplify(a), b; inputs x: Plane
# ---------- python_8: Python ----------
__author__ = "riccardo"
__version__ = "2023.03.01"

import rhinoscriptsyntax as rs
import math

if (x.YAxis.Z < 0):
    x.Rotate(math.pi, x.ZAxis, x.Origin)
    a = x

else:
    a = x

b = x.ZAxis
# ---------- end python_8 ----------

# ---- group: HATCH GREY
cluster = Cluster_2(B=bake_hatch_grey, C=clean)  # -> ho, att; disabled

# ---- group: HATCH COLORS
c_script_9 = CSharpScript(x=clean_2)  # -> A; inputs x: String
# ---------- c_script_9: C# usings ----------
using System.Drawing;
using Rhino.DocObjects;
# ---------- c_script_9: C# ----------
    RhinoDoc doc = RhinoDoc.ActiveDoc;



    ObjectAttributes colorHatchesAtt = new ObjectAttributes();
    colorHatchesAtt.LayerIndex = doc.Layers.FindName("hatch_colors").Index;
    int[] tmp = ColorRB(x);
    Color color = Color.FromArgb(tmp[0], tmp[1], tmp[2]);
    colorHatchesAtt.ObjectColor = color;
    colorHatchesAtt.ColorSource = ObjectColorSource.ColorFromObject;

    A = colorHatchesAtt;
# ---------- c_script_9: C# additional code ----------
  public int[] ColorRB(string layerName)
  {
    int[] k;

    if (layerName == "A")
    {
      k = new int[] { 242, 68, 68, 255 };
      return k;
    }
    else if (layerName.Contains("B"))
    {
      k = new int[] { 82, 137, 227, 255 };
      return k;
    }
    else if (layerName.Contains("K"))
    {
      k = new int[] { 0, 204, 102, 255 };
      return k;
    }
    else if (layerName == "D")
    {
      k = new int[] { 150, 92, 250, 255 };
      return k;
    }
    else if (layerName == "E")
    {
      k = new int[] { 77, 200, 219, 255 };
      return k;
    }
    else if (layerName == "F")
    {
      k = new int[] { 174, 233, 242, 255 };
      return k;
    }
    else if (layerName == "G")
    {
      k = new int[] { 52, 140, 153, 255 };
      return k;
    }
    else if (layerName == "H")
    {
      k = new int[] { 10, 169, 194, 255 };
      return k;
    }
    else if (layerName == "J")
    {
      k = new int[] { 0, 116, 158, 255 };
      return k;
    }
    else if (layerName == "I")
    {
      k = new int[] { 0, 60, 69, 255 };
      return k;
    }
    else
    {
      k = new int[] { 227, 208, 61, 255 };
      return k;
    }
  }
# ---------- end c_script_9 ----------
createhatch = CreateHatch(Bake=bake_hatch_colors, Curves=clean, HatchPatternName="Solid", HatchScale=1, HatchRotation=0, Attributes=c_script_9)  # -> HatchGeometry, HatchObjects; disabled

# ---- group: TEXT-BAKE
textbaker_2 = TextBaker(
    Location=c_script_7,
    Text=clean_3,
    Size="35",
    Attribute="%text",
    Justification=4,
    Bake=bake_texts,
    Dot_Text=False,
    Enable_Mask=True,
    On_Screen=False)  # disabled

# ---- group: OBSTACLE COLORS
cluster_2 = Cluster()
preview = CustomPreview(Geometry=clean, Material=cluster_2)

# ----
wiredisplay = ControlWireDisplay(WireDisplay=2, AllObjects_Object=[scriptpar, scriptpar_4, scriptpar_5])

# ---- group: TEXT-DISPLAY
textbaker_3 = TextBaker(
    Location=c_script_7,
    Text=clean_3,
    Size="35",
    Justification=4,
    Bake=False,
    Dot_Text=False,
    Enable_Mask=True,
    On_Screen=False)

# ==== cluster Cluster
material = CreateMaterial(Diffuse="230,37,232", Specular=RGB(255, 255, 255), Emission=RGB(0, 0, 0), Transparency=0, Shine=0)
M = ClusterOutput(material)

# ==== cluster Counter
button = Button()
button_2 = Button()
_0 = Button()
c_script = CSharpScript(x=button, y=button_2, z=_0, u=Slider(581, range=0..1000))  # -> A; inputs x: Boolean, y: Boolean, z: Boolean, u: Int32
# ---------- c_script: C# ----------
        if(x) a++;
    if(y) a--;
    if (z) a = 0;

    A = a+u;
# ---------- c_script: C# additional code ----------
  int a = 0;
# ---------- end c_script ----------
panel = Panel(c_script)
item = ListItem(Index=c_script, Wrap=True)

# ==== cluster Cluster_2
B = ClusterInput()
C = ClusterInput()
createatts = CreateAttributes(LayerName="hatch_grey", Color=ColourSwatch(SwatchColor=RGB(181, 181, 181)), enableFullPath=False)
createhatch = CreateHatch(Bake=B, Curves=C, HatchPatternName="Solid", HatchScale=1, HatchRotation=0)  # -> HatchGeometry, HatchObjects
createhatch_2 = CreateHatch(Bake=B, Curves=C, HatchPatternName="Solid", HatchScale=1, HatchRotation=0, Attributes=createatts)  # -> HatchGeometry, HatchObjects
ho = ClusterOutput(createhatch.HatchObjects)
att = ClusterOutput(createatts)
