# Grasshopper definition AutoPanel_autosave.gh (Grasshopper 1.0.7)
# plug-ins: EleFront, Human, Pufferfish, Heteroptera, MetaHopper

layertable = LayerTable(Update=True, AutoUpdate=True)  # -> Layers, FullLayerPaths, LayerColors, Linetypes, MaterialNames, Visible, PrintWidth, PrintColor
# Da Rhino assicurarsi di avere i layer così ordinati:
# -------------------
# dir-border-h
# dir-border-v
# 
# dir-h-x.x
# ...
# dir-v-x.x
# ...
# -------------------
# i primi due sono DUE LINEE che determinano i bordi dell'area da pannellare. I bordi avranno anch'essi una fuga e andranno ridisegnati nei layer delle fughe
# 
# I layer seguenti sono tutte le fughe centrate che il codice utilizza per creare i pannelli
# -------------------
# obs-[...]
# -------------------
# gli ostacoli
python = GhPythonScript(x=layertable.Layers)  # -> a; inputs x: list
# ---------- python: Python ----------
__author__ = "riccardo"
__version__ = "2023.02.16"

import rhinoscriptsyntax as rs

list = []

for i in x:
    if (i.split('-')[0] == 'dir'):
        list.append(i)

a = list
# ---------- end python ----------
panel = Panel(python)

# ---- group: OLD
cluster = Cluster()

# ----
reflay = ReferenceByLayer(LayerName="dir-border-h")
reflay_2 = ReferenceByLayer(LayerName="dir-border-v")
reflay_3 = ReferenceByLayer(LayerName="dir-h-2.2")
reflay_4 = ReferenceByLayer(LayerName="dir-h-8.8")
reflay_5 = ReferenceByLayer(LayerName="dir-v-8.8")

number_slider = Slider(8, range=0..10)

# ---- group: BASE VECTOR
end = EndPoints(Curve=reflay)  # -> Start, End
vec2pt = Vector2Pt(PointA=end.Start, PointB=end.End, Unitize=False)  # -> Vector, Length

# ---- group: HEIGHT VECTOR
end_2 = EndPoints(Curve=reflay_2)  # -> Start, End
vec2pt_2 = Vector2Pt(PointA=end_2.Start, PointB=end_2.End, Unitize=False)  # -> Vector, Length

# ---- group: Origin
end_3 = EndPoints(Curve=reflay)  # -> Start, End
pt = Point(end_3.Start)

# ----
B = Geometry(reflay)

# ---- group: H
geo = Geometry(reflay_2)

# ----
python_2 = GhPythonScript(x="dir-h-2.2")  # -> a, b
# ---------- python_2: Python ----------
__author__ = "riccardo"
__version__ = "2023.02.16"

import rhinoscriptsyntax as rs

if (x.split('-')[2].split('.')[0] == x.split('-')[2].split('.')[1]):
    a = x.split('-')[2].split('.')[0]
    b = -float(a)
# ---------- end python_2 ----------
python_3 = GhPythonScript(x="dir-h-8.8")  # -> a, b; same code as python_2
python_4 = GhPythonScript(x="dir-v-8.8")  # -> a, b; same code as python_2

offcrv = OffsetCurve(Curve=B, Plane=PlaneXY(0, 0, 0), Distance=number_slider, BothSides=expr("-x", number_slider), Kinks=0, CapType=0)  # -> flatten(Offset)
offcrv_2 = OffsetCurve(Curve=geo, Plane=PlaneXY(0, 0, 0), Distance=number_slider, BothSides=expr("-x", number_slider), Kinks=0, CapType=0)  # -> flatten(Offset)
offcrv_3 = OffsetCurve(Curve=reflay_3, Plane=PlaneXY(0, 0, 0), Distance=python_2.a, BothSides=python_2.b, Kinks=0, CapType=0)  # -> flatten(Offset)
offcrv_4 = OffsetCurve(Curve=reflay_4, Plane=PlaneXY(0, 0, 0), Distance=python_3.a, BothSides=python_3.b, Kinks=0, CapType=0)  # -> flatten(Offset)
offcrv_5 = OffsetCurve(Curve=reflay_5, Plane=PlaneXY(0, 0, 0), Distance=python_4.a, BothSides=python_4.b, Kinks=0, CapType=0)  # -> flatten(Offset)

merge = Merge(Data1=offcrv_3, Data2=offcrv_4)
merge_2 = Merge(Data1=offcrv_5)

merge_3 = Merge(Data1=offcrv, Data2=merge_2)
merge_4 = Merge(Data1=offcrv_2, Data2=merge)

mcx = MultipleCurves(Curves=merge_3)  # -> Points, IndexA, IndexB, ParamA, ParamB
mcx_2 = MultipleCurves(Curves=merge_4)  # -> Points, IndexA, IndexB, ParamA, ParamB

list = ValueList({"Type A": 0, "Type B": 1, "Type C": 2}, selected="Type A")
list_2 = ValueList({"Type A": 0, "Type B": 1, "Type C": 2}, selected="Type A")
list_3 = ValueList({"Type A": 0, "Type B": 1, "Type C": 2}, selected="Type B")
list_4 = ValueList({"Type A": 0, "Type B": 1, "Type C": 2}, selected="Type C")
python_5 = GhPythonScript(x=list_3)  # -> a; inputs x: Int32
# ---------- python_5: Python ----------
__author__ = "riccardo"
__version__ = "2023.02.20"

import rhinoscriptsyntax as rs
b = ''

if (x == 0):
    b = 'Type A'
elif (x ==1):
    b = 'Type B'
elif (x == 2):
    b = 'Type C'

a = b
# ---------- end python_5 ----------
python_6 = GhPythonScript(x=list)  # -> a; inputs x: Int32; same code as python_5
python_7 = GhPythonScript(x=list_4)  # -> a; inputs x: Int32; same code as python_5
python_8 = GhPythonScript(x=list_2)  # -> a; inputs x: Int32; same code as python_5

# ---- group: 1
merge_5 = Merge(Data1=vec2pt.Vector, Data2=vec2pt_2.Vector, Data3=Slider(1932, range=0..10000), Data4="dir-h-8.8", Data5=python_5)  # -> flatten(Result)

# ---- group: 2
merge_6 = Merge(Data1=vec2pt.Vector, Data2=vec2pt_2.Vector, Data3=Slider(1123, range=0..10000), Data4="dir-v-8.8", Data5=python_6)  # -> flatten(Result)

# ---- group: 3
merge_7 = Merge(Data1=vec2pt.Vector, Data2=vec2pt_2.Vector, Data3=Slider(2567, range=0..10000), Data4="dir-h-8.8", Data5=python_7)  # -> flatten(Result)

# ---- group: 4
merge_8 = Merge(Data1=vec2pt.Vector, Data2=vec2pt_2.Vector, Data3=Slider(998, range=0..10000), Data4="dir-v-8.8", Data5=python_8)  # -> flatten(Result)

# ----
entwine = Entwine(Branch00=merge_5, Branch01=merge_6, Branch02=merge_7, Branch03=merge_8, FlattenInputs=True)
layertable_2 = LayerTable(Update=True, AutoUpdate=True)  # -> Layers, FullLayerPaths, LayerColors, Linetypes, MaterialNames, Visible, PrintWidth, PrintColor
python_9 = GhPythonScript(x=layertable_2.Layers)  # -> a; inputs x: list
# ---------- python_9: Python ----------
__author__ = "riccardo"
__version__ = "2023.02.16"

import rhinoscriptsyntax as rs

list = []

for i in x:
    if (i.split('-')[0] == 'obs'):
        list.append(i)

a = list
# ---------- end python_9 ----------
item = ListItem(List=python_9, Index="1", Wrap=True)  # -> flatten(Item)
panel_2 = Panel(item)
reflay_6 = ReferenceByLayer(LayerName=panel_2)

# ---- group: ACTIVATE
onoff = EnableDisableObject(Enabled=Toggle(False), AllObjects_Object=[python_16, layers, qb])

# ---- group: VIEW
hideshow = HideShowObjectPreview(Visible=Toggle(True), AllObjects_Object=[merge_10, textbaker])

# ---- group: POINTS
c_script = CSharpScript(ptsX=mcx.Points, ptsY=mcx_2.Points, origin=pt)  # -> OptsX, OptsY; inputs ptsX: list of Point3d, ptsY: list of Point3d, origin: Point3d
# ---------- c_script: C# usings ----------
using System.Linq;
# ---------- c_script: C# ----------
    OptsX = Order(ptsX, 'x');
    OptsY = Order(ptsY, 'y');
# ---------- c_script: C# additional code ----------
  public List<Point3d> Order(List<Point3d> pts, char axis)
  {
    List<Point3d> sortedList = new List<Point3d>();

    double x = pts[1].X - pts[0].X;
    double y = pts[1].Y - pts[0].Y;

    if (axis == 'x')
    {
      if (x > y)
      {
        sortedList = pts.OrderBy(point => point.Y).ToList();
      }
      else
      {
        sortedList = pts.OrderBy(point => point.X).ToList();
      }
    }
    else
    {
      if (x < y)
      {
        sortedList = pts.OrderBy(point => point.Y).ToList();
      }
      else
      {
        sortedList = pts.OrderBy(point => point.X).ToList();
      }
    }

    return sortedList;
  }
# ---------- end c_script ----------

# ---- group: POINTS / Height Points
pt_2 = Point(c_script.OptsY)

# ----
lng = ListLength(List=pt_2)
lng_2 = ListLength(List=pt_2)

# ---- group: BORDERS / 4
geo_2 = Geometry(pt_2)

# ---- group: POINTS / Base Points
pt_3 = Point(c_script.OptsX)

# ----
lng_3 = ListLength(List=pt_3)  # -> expr("x-1", Length)
lng_4 = ListLength(List=pt_3)
lng_5 = ListLength(List=pt_3)
series = Series(Start=expr("x-1", lng_4), Step=lng_4, Count=lng)  # -> flatten(Series)
python_10 = GhPythonScript(b=lng_3)  # -> flatten(a)
# ---------- python_10: Python ----------
__author__ = "riccardo"
__version__ = "2023.02.17"

import rhinoscriptsyntax as rs

a = str(str(0) + ' to ' + str(b))
# ---------- end python_10 ----------
python_11 = GhPythonScript(b=lng_5, h=lng_2)  # -> flatten(a)
# ---------- python_11: Python ----------
__author__ = "riccardo"
__version__ = "2023.02.17"

import rhinoscriptsyntax as rs

a = str(b*(h-1))+ ' to ' + str(b*h)
# ---------- end python_11 ----------

# ---- group: POINTS (continued)
item_2 = ListItem(List=pt_2, Index=0, Wrap=True)
cull_i = CullIndex(List=pt_2, Indices=0, Wrap=True)
vec2pt_3 = Vector2Pt(PointA=item_2, PointB=cull_i, Unitize=False)  # -> Vector, Length
crossref = CrossReference(ListA=pt_3, ListB=vec2pt_3.Vector, CrossMode=1)  # -> ListA, ListB
move = Move(Geometry=crossref.ListA, Motion=crossref.ListB)  # -> Geometry, Transform

ins = InsertItems(List=move.Geometry, Item=pt_3, Indices=0, Wrap=True)

# ----
subset = SubList(List=ins, Domain=python_10, Wrap=False)  # -> List, Index
subset_2 = SubList(List=ins, Domain=python_11, Wrap=False)  # -> List, Index
item_3 = ListItem(List=ins, Index=series, Wrap=True)

# ---- group: BORDERS / 1
geo_3 = Geometry(subset.List)

# ---- group: BORDERS / 2
geo_4 = Geometry(item_3)

# ---- group: BORDERS / 3
geo_5 = Geometry(subset_2.List)

# ----
entwine_2 = Entwine(Branch00=geo_3, Branch01=geo_4, Branch02=geo_5, Branch03=geo_2, FlattenInputs=True)

# ---- group: Y PARAM
lng_6 = ListLength(List=pt_3)

# ---- group: GENERATOR
c_script_2 = CSharpScript(x=ins, y=lng_6)  # -> flatten(A), flatten(B), C; inputs x: list of Point3d, y: Int32
# ---------- c_script_2: C# ----------
    List<Polyline> panels = new List<Polyline>();
    List<string> panelsNames = new List<string>();
    List<Point3d> corners = new List<Point3d>();

    int k = x.Count - y - 1;

    for (int i = 0; i < k; i = i + 2)
    {
      int a = i + 1;
      int c = i / y;
      if (c % 2 == 0)
      {
        panels.Add(Panel(x, i, y));
      }
    }

    for (int i = 0; i < panels.Count; i++)
    {
      panelsNames.Add(PanelData(panels[i], i));
    }

    int z = y / 2;
    corners.Add(panels[0][0]);
    corners.Add(panels[z - 1][1]);
    corners.Add(panels[panels.Count - 1][2]);
    corners.Add(panels[panels.Count - z][3]);

    A = panels;
    B = panelsNames;
    C = corners;
# ---------- c_script_2: C# additional code ----------
  public Polyline Panel(List < Point3d > pointList, int i, int y)
  {
    List<Point3d> pList = new List<Point3d>() {
        pointList[i],
        pointList[i + 1],
        pointList[i + y + 1],
        pointList[i + y],
        pointList[i]
        };

    Polyline pl = new Polyline(pList);

    return pl;
  }

  public string PanelData(Polyline pl, int i)
  {
    double ba = pl[0].DistanceTo(pl[1]);
    double he = pl[1].DistanceTo(pl[2]);

    string item = Math.Round(ba, 0).ToString() + '-' + Math.Round(he, 0).ToString() + '|' + i.ToString();
    return item;
  }
# ---------- end c_script_2 ----------

c_script_3 = CSharpScript(pts=entwine_2, param=entwine)  # -> A, flatten(B), C; inputs pts: tree of Point3d, param: tree
# ---------- c_script_3: C# ----------
    List < List < Point3d >> llist = new List<List < Point3d >>{
        new List<Point3d>(),
        new List<Point3d>(),
        new List<Point3d>(),
        new List<Point3d>(),
        };
    List<double> corners = new List<double>();
    List<Polyline> panels = new List<Polyline>();
    List<string> panelsNames = new List<string>();
    List<int> borderList = new List<int>();

    for (int i = 0; i < pts.BranchCount; i++)
    {
      double b = Convert.ToInt32(param.Branch(i)[1].ToString().Split('-')[2].Split('.')[0]) * 2;
      double c = Convert.ToInt32(param.Branch(i)[0]);

      if (i == 0)
      {
        for (int j = 0; j < pts.Branch(i).Count; j++)
        {

          if (j % 2 == 0)
          {
            llist[i].Add(new Point3d(pts.Branch(i)[j].X, pts.Branch(i)[j].Y - c, pts.Branch(i)[j].Z));
            llist[i].Add(new Point3d(pts.Branch(i)[j].X, pts.Branch(i)[j].Y - b, pts.Branch(i)[j].Z));

          }
          else
          {
            llist[i].Add(new Point3d(pts.Branch(i)[j].X, pts.Branch(i)[j].Y - b, pts.Branch(i)[j].Z));
            llist[i].Add(new Point3d(pts.Branch(i)[j].X, pts.Branch(i)[j].Y - c, pts.Branch(i)[j].Z));
          }
        }

        for (int j = 0; j < llist[i].Count; j = j + 4)
        {
          panels.Add(Panel(llist[i], j));
          borderList.Add(i);
        }

        corners.Add(b);
        corners.Add(c);
      }

      else if (i == 1)
      {
        for (int j = 0; j < pts.Branch(i).Count; j++)
        {

          if (j % 2 == 0)
          {
            llist[i].Add(new Point3d(pts.Branch(i)[j].X + c, pts.Branch(i)[j].Y, pts.Branch(i)[j].Z));
            llist[i].Add(new Point3d(pts.Branch(i)[j].X + b, pts.Branch(i)[j].Y, pts.Branch(i)[j].Z));

          }
          else
          {
            llist[i].Add(new Point3d(pts.Branch(i)[j].X + b, pts.Branch(i)[j].Y, pts.Branch(i)[j].Z));
            llist[i].Add(new Point3d(pts.Branch(i)[j].X + c, pts.Branch(i)[j].Y, pts.Branch(i)[j].Z));
          }
        }

        for (int j = 0; j < llist[i].Count; j = j + 4)
        {
          panels.Add(Panel(llist[i], j));
          borderList.Add(i);
        }

        corners.Add(b);
        corners.Add(c);
      }

      else if (i == 2)
      {
        for (int j = 0; j < pts.Branch(i).Count; j++)
        {

          if (j % 2 == 0)
          {
            llist[i].Add(new Point3d(pts.Branch(i)[j].X, pts.Branch(i)[j].Y + c, pts.Branch(i)[j].Z));
            llist[i].Add(new Point3d(pts.Branch(i)[j].X, pts.Branch(i)[j].Y + b, pts.Branch(i)[j].Z));

          }
          else
          {
            llist[i].Add(new Point3d(pts.Branch(i)[j].X, pts.Branch(i)[j].Y + b, pts.Branch(i)[j].Z));
            llist[i].Add(new Point3d(pts.Branch(i)[j].X, pts.Branch(i)[j].Y + c, pts.Branch(i)[j].Z));
          }
        }

        for (int j = 0; j < llist[i].Count; j = j + 4)
        {
          panels.Add(Panel(llist[i], j));
          borderList.Add(i);
        }

        corners.Add(b);
        corners.Add(c);
      }

      else if (i == 3)
      {
        for (int j = 0; j < pts.Branch(i).Count; j++)
        {

          if (j % 2 == 0)
          {
            llist[i].Add(new Point3d(pts.Branch(i)[j].X - c, pts.Branch(i)[j].Y, pts.Branch(i)[j].Z));
            llist[i].Add(new Point3d(pts.Branch(i)[j].X - b, pts.Branch(i)[j].Y, pts.Branch(i)[j].Z));

          }
          else
          {
            llist[i].Add(new Point3d(pts.Branch(i)[j].X - b, pts.Branch(i)[j].Y, pts.Branch(i)[j].Z));
            llist[i].Add(new Point3d(pts.Branch(i)[j].X - c, pts.Branch(i)[j].Y, pts.Branch(i)[j].Z));
          }
        }

        for (int j = 0; j < llist[i].Count; j = j + 4)
        {
          panels.Add(Panel(llist[i], j));
          borderList.Add(i);
        }

        corners.Add(b);
        corners.Add(c);
      }
    }

    for (int i = 0; i < panels.Count; i++)
    {
      string type = Convert.ToString(param.Branch(borderList[i])[2]);
      string name = type + '\n' + PanelData(panels[i], i);
      panelsNames.Add(name);
    }

    A = panels;
    B = panelsNames;
    C = corners;
# ---------- c_script_3: C# additional code ----------
  public Polyline Panel(List < Point3d > pointList, int i)
  {
    List<Point3d> pList = new List<Point3d>() {
        pointList[i],
        pointList[i + 1],
        pointList[i + 2],
        pointList[i + 3],
        pointList[i]
        };

    Polyline pl = new Polyline(pList);

    return pl;
  }

  public string PanelData(Polyline pl, int i)
  {
    double ba = pl[0].DistanceTo(pl[1]);
    double he = pl[1].DistanceTo(pl[2]);

    string item = Math.Round(ba, 0).ToString() + '-' + Math.Round(he, 0).ToString() + '|' + i.ToString();
    return item;
  }
# ---------- end c_script_3 ----------

# ---- group: PLINES
geo_6 = Geometry(c_script_2.A)

# ---- group: GENERATOR
c_script_4 = CSharpScript(pts=c_script_2.C, corners=c_script_3.C, param=entwine)  # -> A, flatten(B); inputs pts: list of Point3d, corners: list of Double, param: tree
# ---------- c_script_4: C# ----------
    List<Polyline> panels = new List<Polyline>();
    List<string> panelsNames = new List<string>();

    int p = 0;

    List<Point3d> pList0 = new List<Point3d>() {
        new Point3d(pts[p].X - corners[6], pts[p].Y - corners[0], 0),
        new Point3d(pts[p].X - corners[7], pts[p].Y - corners[0], 0),
        new Point3d(pts[p].X - corners[7], pts[p].Y - corners[1], 0),
        new Point3d(pts[p].X - corners[6], pts[p].Y - corners[1], 0),
        new Point3d(pts[p].X - corners[6], pts[p].Y - corners[0], 0)
        };

    Polyline p0 = new Polyline(pList0);

    panels.Add(p0);

    p = 1;

    List<Point3d> pList1 = new List<Point3d>() {
        new Point3d(pts[p].X + corners[2], pts[p].Y - corners[0], 0),
        new Point3d(pts[p].X + corners[3], pts[p].Y - corners[0], 0),
        new Point3d(pts[p].X + corners[3], pts[p].Y - corners[1], 0),
        new Point3d(pts[p].X + corners[2], pts[p].Y - corners[1], 0),
        new Point3d(pts[p].X + corners[2], pts[p].Y - corners[0], 0)
        };

    Polyline p1 = new Polyline(pList1);

    panels.Add(p1);

    p = 2;

    List<Point3d> pList2 = new List<Point3d>() {
        new Point3d(pts[p].X + corners[2], pts[p].Y + corners[4], 0),
        new Point3d(pts[p].X + corners[3], pts[p].Y + corners[4], 0),
        new Point3d(pts[p].X + corners[3], pts[p].Y + corners[5], 0),
        new Point3d(pts[p].X + corners[2], pts[p].Y + corners[5], 0),
        new Point3d(pts[p].X + corners[2], pts[p].Y + corners[4], 0)
        };

    Polyline p2 = new Polyline(pList2);

    panels.Add(p2);

    p = 3;

    List<Point3d> pList3 = new List<Point3d>() {
        new Point3d(pts[p].X - corners[6], pts[p].Y + corners[4], 0),
        new Point3d(pts[p].X - corners[6], pts[p].Y + corners[5], 0),
        new Point3d(pts[p].X - corners[7], pts[p].Y + corners[5], 0),
        new Point3d(pts[p].X - corners[7], pts[p].Y + corners[4], 0),
        new Point3d(pts[p].X - corners[6], pts[p].Y + corners[4], 0)
        };

    Polyline p3 = new Polyline(pList3);

    panels.Add(p3);

    for (int i = 0; i < panels.Count; i++)
    {
      string type = Convert.ToString(param.Branch(i)[2]);
      string name = type + '\n' + PanelData(panels[i], i);
      panelsNames.Add(name);
    }

    A = panels;
    B = panelsNames;
# ---------- c_script_4: C# additional code ----------
  public Polyline Panel(List < Point3d > pointList, int i)
  {
    List<Point3d> pList = new List<Point3d>() {
        pointList[i],
        pointList[i + 1],
        pointList[i + 2],
        pointList[i + 3],
        pointList[i]
        };

    Polyline pl = new Polyline(pList);

    return pl;
  }

  public string PanelData(Polyline pl, int i)
  {
    double ba = pl[0].DistanceTo(pl[1]);
    double he = pl[1].DistanceTo(pl[2]);

    string item = Math.Round(ba, 0).ToString() + '-' + Math.Round(he, 0).ToString() + '|' + i.ToString();
    return item;
  }
# ---------- end c_script_4 ----------

# ----
geo_7 = Geometry(c_script_4.A)
geo_8 = Geometry(c_script_3.A)
python_12 = GhPythonScript(x=c_script_3.B)  # -> a; inputs x: list
# ---------- python_12: Python ----------
__author__ = "riccardo"
__version__ = "2023.02.20"

import rhinoscriptsyntax as rs

list = []

for i in range(len(x)):
    list.append(x[i].split('\n')[1])

a = list
# ---------- end python_12 ----------
python_13 = GhPythonScript(x=c_script_4.B)  # -> a; inputs x: list; same code as python_12

# ---- group: NOMI DISPLAY
merge_9 = Merge(Data1=c_script_2.B, Data2=c_script_3.B, Data3=c_script_4.B)  # -> flatten(Result)

# ---- group: PLINES
merge_10 = Merge(Data1=geo_6, Data2=geo_8, Data3=geo_7)  # -> flatten(Result)

# ---- group: NOMI
merge_11 = Merge(Data1=c_script_2.B, Data2=python_12, Data3=python_13)  # -> flatten(Result)

# ---- group: REMAP NUMBERS
python_14 = GhPythonScript(x=merge_11)  # -> a; inputs x: list
# ---------- python_14: Python ----------
__author__ = "riccardo"
__version__ = "2023.02.20"

import rhinoscriptsyntax as rs

list = []

for i in range(len(x)):
    list.append(x[i].split('|')[0] + '|' + str(i))

a = list
# ---------- end python_14 ----------

python_15 = GhPythonScript(x=merge_9)  # -> a; inputs x: list; same code as python_14

# ---- group: ARCHIVE
python_16 = GhPythonScript(x=python_14)  # -> a, b; inputs x: list; disabled
# ---------- python_16: Python ----------
__author__ = "riccardo"
__version__ = "2023.02.16"

import rhinoscriptsyntax as rs

list = []
panelLayer = []

for i in range(len(x)):
    a = x[i].split('-')
    list.append([float(a[0]),float(a[1].split('|')[0]), x[i].split('|')[0],i])
    panelLayer.append('%' + x[i].split('|')[0])

list = sorted(list, key = lambda x: (x[0], x[1]))

archive = [list[0][2]]


for i in range(1, len(x)):
    if (list[i][2] != list[i-1][2]):
        archive.append(list[i][2])

a = archive
b = panelLayer
# ---------- end python_16 ----------

# ----
area = Area(Geometry=merge_10)  # -> Area, Centroid

# ---- group: LAYERS
layers = CreateModifyLayers(LayerName=python_16.a, DeleteLayer=False, enableFullPath=False)  # -> LayerNames, LayerFullPath; disabled

# ----
# Click Bake su tutti e due i bottoni,
# uno per il testo e uno per le geometrie
panel_3 = Panel("BAKING STATION")
bake = Button()
qb = QuickBaker(Geometric=merge_10, Attribute=python_16.b, Bake=False)  # disabled

textbaker = TextBaker(
    Location=area.Centroid,
    Text=python_15,
    Size="100",
    Attribute=python_16.b,
    Justification=4,
    Bake=bake,
    Dot_Text=False,
    Enable_Mask=True,
    On_Screen=False)
c_script_5 = CSharpScript(x=merge_10, y=python_14, z=python_15)  # -> A; inputs x: list of Polyline, y: list of String, z: list of String
# ---------- c_script_5: C# ----------
    string a = "OK";
    string b = "ALERT";

    bool c = true;
    
    if (x.Count != y.Count || y.Count != z.Count) {c = false;}
    
    //    int d = 0;
    //    for (int i = 0; i < x.Count; i++)
    //    {
    //      if (y[i] != z[i])
    //      {d++;}
    //
    //      if (d != 0) {c = false;}
    //    }

    if (c) A = a;
    else A = b;
# ---------- end c_script_5 ----------
panel_4 = Panel(c_script_5)
c_script_6 = CSharpScript(plines=merge_10, txt=python_15, obs=reflay_6)  # -> A; inputs plines: list of Polyline, obs: list of Polyline
# ---------- c_script_6: C# ----------
    List<Polyline> final = new List<Polyline>();
    List<Point3d> tmp = new List<Point3d>();

    foreach(var i in plines)
    {
      
    }
# ---------- c_script_6: C# additional code ----------
  public bool Check(Polyline tested, Polyline test)
  {
    return true;
  }
# ---------- end c_script_6 ----------
cluster_2 = Cluster_2(x=panel_4)

# ==== cluster Cluster
B = Geometry(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)  # disabled

# ---- group: H
geo = Geometry(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)  # disabled

# ----
list = ValueList({"Lenght": 0, "Divisions": 1}, selected="Lenght")  # disabled
gate = StreamGate(Stream=B, Gate=list)  # -> Target0, Target1; disabled
gate_2 = StreamGate(Stream=geo, Gate=list)  # -> Target0, Target1; disabled
number_slider = Slider(3000, range=0..3000)  # disabled
number_slider_2 = Slider(950, range=0..1000)  # disabled
divlength = DivideLength(Curve=gate.Target0, Length=expr("x*0.001", number_slider))  # -> Points, Tangents, Parameters; disabled
divlength_2 = DivideLength(Curve=gate_2.Target0, Length=expr("x*0.001", number_slider_2))  # -> Points, Tangents, Parameters; disabled
end = EndPoints(Curve=gate.Target0)  # -> Start, End; disabled
lng = ListLength(List=divlength.Points)  # disabled
ins = InsertItems(List=divlength.Points, Item=end.End, Indices=lng, Wrap=True)  # disabled
panel = Panel("0")  # disabled
cull_i = CullIndex(List=divlength_2.Points, Indices=panel, Wrap=True)  # disabled
end_2 = EndPoints(Curve=gate_2.Target0)  # -> Start, End; disabled
item = ListItem(List=divlength_2.Points, Index=panel, Wrap=True)  # disabled
lng_2 = ListLength(List=cull_i)  # disabled
ins_2 = InsertItems(List=cull_i, Item=end_2.End, Indices=lng_2, Wrap=True)  # disabled
vec2pt = Vector2Pt(PointA=item, PointB=ins_2, Unitize=False)  # -> Vector, Length; disabled
crossref = CrossReference(ListA=ins, ListB=vec2pt.Vector, CrossMode=1)  # -> ListA, ListB; disabled
move = Move(Geometry=crossref.ListA, Motion=crossref.ListB)  # -> Geometry, Transform; disabled
ins_3 = InsertItems(List=move.Geometry, Item=ins, Indices=0, Wrap=True)  # disabled
lng_3 = ListLength(List=ins)  # disabled
c_script = CSharpScript(x=ins_3, y=lng_3)  # -> flatten(A), flatten(B); inputs x: list of Point3d, y: Int32; disabled
# ---------- c_script: C# ----------
    List<Polyline> panels = new List<Polyline>();
    List<string> panelsNames = new List<string>();

    int k = x.Count - y - 1;

    for (int i = 0; i < k; i++)
    {
      int a = i + 1;
      if (a % y != 0)
      {
        panels.Add(Panel(x, i, y));

      }
    }

    for (int i = 0; i < panels.Count; i++)
    {
      panelsNames.Add(PanelData(panels[i]));
    }

    A = panels;
    B = panelsNames;
# ---------- c_script: C# additional code ----------
  public Polyline Panel(List < Point3d > pointList, int i, int y)
  {
    List<Point3d> pList = new List<Point3d>() {
        pointList[i],
        pointList[i + 1],
        pointList[i + y + 1],
        pointList[i + y],
        pointList[i]
        };

    Polyline pl = new Polyline(pList);

    return pl;
  }

  public string PanelData(Polyline pl)
  {
    double ba = pl[0].DistanceTo(pl[1]);
    double he = pl[1].DistanceTo(pl[2]);

    string item = Math.Round(ba, 0).ToString() + '-' + Math.Round(he, 0).ToString();
    return item;
  }
# ---------- end c_script ----------
txt = Text(c_script.B)  # disabled

# ---- group: Polylines
geo_2 = Geometry(c_script.A)  # disabled

# ----
panel_2 = Panel("%")  # disabled
python = GhPythonScript(x=c_script.B)  # -> a, b; inputs x: list; disabled
# ---------- python: Python ----------
__author__ = "riccardo"
__version__ = "2023.02.16"

import rhinoscriptsyntax as rs

list = []

for i in range(len(x)):
    a = x[i].split('-')
    list.append([float(a[0]),float(a[1]),x[i],i])

list = sorted(list, key = lambda x: (x[0], x[1]))

archive = [list[0][2]]

for i in range(1, len(x)):
    if (list[i][2] != list[i-1][2]):
        archive.append(list[i][2])

a = list
b= archive
# ---------- end python ----------
concat = Concatenate(FragmentA=panel_2, FragmentB=txt)  # disabled
python_2 = GhPythonScript(x=python.a)  # -> simplify(a); disabled
# ---------- python_2: Python ----------
__author__ = "riccardo"
__version__ = "2023.02.16"

import rhinoscriptsyntax as rs

a = x
# ---------- end python_2 ----------
button = Button()  # disabled
area = Area(Geometry=geo_2)  # -> Area, Centroid; disabled
panel_3 = Panel("0.1")  # disabled
layers = CreateModifyLayers(LayerName=python.b, DeleteLayer=False, enableFullPath=False)  # -> LayerNames, LayerFullPath; disabled
qb = QuickBaker(Geometric=geo_2, Attribute=concat, Bake=False)  # disabled
textbaker = TextBaker(
    Location=area.Centroid,
    Text=txt,
    Size=panel_3,
    Attribute=concat,
    Justification=4,
    Bake=button,
    Dot_Text=False,
    Enable_Mask=True,
    On_Screen=False)  # disabled

# ==== cluster Cluster_2
x = ClusterInput()
python = GhPythonScript(x=x)  # -> a
# ---------- python: Python ----------
__author__ = "riccardo"
__version__ = "2023.02.20"

import rhinoscriptsyntax as rs

if (x == 'OK'):
    a ='30, 153, 14'
elif (x == 'ALERT'):
    a = '245, 66, 66'
# ---------- end python ----------
setpanel = SetPanelProperties(Panel="Grasshopper.Kernel.Types.GH_ObjectWrapper", Color=python)
